# Grasshopper definition Tinyhouse Generator.gh (Grasshopper 1.0.7)
# plug-ins: Sasquatch, Magnetizing_FPG, Pufferfish, Nautilus

klimazone = GetString("Cwc Temperate-Dry_Winter-Cold_Summer", AtLeast=1, AtMost=1, Prompt="Klimazone", TreeAccess=False)
# https://www.sciencedirect.com/science/article/pii/S0038092X16002188#:~:text=Window%2Dto%2Dwall%20ratio%20(,not%20for%20south%2Dfacing%20fa%C3%A7ades.
panel = Panel(klimazone)
txt = Text(panel)

panel_2 = Panel("C:\Users\mfls\OneDrive\Uni\Master\Code\Tinyhouse Generator\files\EpwZipUrls.csv")
python = GhPythonScript(csv_path=panel_2, target_lat=Slider(22.5, range=-90..90), target_lon=Slider(10, range=-90..90))  # -> nearest_station_url, shortest_distance
# ---------- python: Python ----------
__author__ = "mfls"
__version__ = "2024.06.07"
        
import rhinoscriptsyntax as rs
import math

nearest_station_url = None
shortest_distance = float('inf')

def haversine(lat1, lon1, lat2, lon2):
    # Convert decimal degrees to radians
    lat1, lon1, lat2, lon2 = map(math.radians, [lat1, lon1, lat2, lon2])

    # Haversine formula 
    dlat = lat2 - lat1 
    dlon = lon2 - lon1 
    a = math.sin(dlat/2)**2 + math.cos(lat1) * math.cos(lat2) * math.sin(dlon/2)**2
    c = 2 * math.asin(math.sqrt(a)) 
    r = 6371.0088 # Radius of earth
    return c * r

# CSV open and read
file = open(csv_path, 'r')
lines = file.readlines()

file.close()

# Skip the header row if it exists and doesnt include information
header = lines[0].strip().split(';')
if header[1].lower() == 'lat' and header[2].lower() == 'lon':
    lines = lines[1:]

for line in lines:
    line = line.strip("\n")
    
    # Split line with comma: creates individual lists of strings
    csvInfo = line.split(';')
    lat = float(csvInfo[1])
    lon = float(csvInfo[2])
    distance = haversine(target_lat, target_lon, lat, lon) 
    if distance < shortest_distance:
            shortest_distance = distance
            nearest_station_url = csvInfo[3]
# ---------- end python ----------
panel_3 = Panel(python.nearest_station_url)

panel_4 = Panel("C:\Users\mfls\OneDrive\Uni\Master\Code\Tinyhouse Generator\files\ClimateLookupTable.csv")
panel_5 = Panel("Dachaufbau höhe")  # disabled
panel_6 = Panel("Kurve ganz Außen")  # disabled
panel_7 = Panel("Brep Dach Außen")  # disabled
python_2 = GhPythonScript(csv_path=panel_4, Klimazone=txt)  # -> Temperatur, Feuchtigkeit, Tragwerk, Dämmung, Belüftet, Dach, Dachüberstand, WWR_Nord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
# ---------- python_2: Python ----------
__author__ = "mfls"
__version__ = "2024.06.07"

import rhinoscriptsyntax as rs

# Function to search for a specific climate zone in the CSV and return its values
def search_climate_zone(csv_path, target_klimazone):
    # Initialize variables for output
    Temperatur = None
    Feuchtigkeit = None
    Tragwerk = None
    Dämmung = None
    Belüftet = None
    Dach = None
    Dachüberstand = None
    WWR_Nord = None
    WWR_Ost = None
    WWR_Süd = None
    WWR_West = None
    Seitenverhältnis_y_x = None
    Dachneigung = None
    Fundamenttiefe = None

    # Open and read the CSV file
    file = open(csv_path, 'r')
    lines = file.readlines()
    file.close()

    # Skip the header row
    header = lines[0].strip().split(';')
    lines = lines[1:]

    # Iterate through the CSV lines
    for line in lines:
        line = line.strip("\n")
        
        # Split the line into individual fields
        csvInfo = line.split(';')
        
        # Check if the Klimazone matches the target Klimazone
        if csvInfo[0] == target_klimazone:
            Temperatur = csvInfo[1]
            Feuchtigkeit = csvInfo[2]
            Tragwerk = csvInfo[3]
            Dämmung = csvInfo[4]
            Belüftet = csvInfo[5]
            Dach = csvInfo[6]
            Dachüberstand = csvInfo[7]
            WWR_Nord = csvInfo[8]
            WWR_Ost = csvInfo[9]
            WWR_Süd = csvInfo[10]
            WWR_West = csvInfo[11]
            Seitenverhältnis_y_x = csvInfo[12]
            Dachneigung = csvInfo[13]
            Fundamenttiefe = csvInfo[14]
            break

    # Outputs
    return Temperatur, Feuchtigkeit, Tragwerk, Dämmung, Belüftet, Dach, Dachüberstand, WWR_Nord, WWR_Ost, WWR_Süd, WWR_West, Seitenverhältnis_y_x, Dachneigung, Fundamenttiefe

target_klimazone = Klimazone

# Call the function and get the outputs
Temperatur, Feuchtigkeit, Tragwerk, Dämmung, Belüftet, Dach, Dachüberstand, WWR_Nord, WWR_Ost, WWR_Süd, WWR_West, Seitenverhältnis_y_x, Dachneigung, Fundamenttiefe = search_climate_zone(csv_path, target_klimazone)

# Set the outputs for Grasshopper
Temperatur = Temperatur
Feuchtigkeit = Feuchtigkeit
Tragwerk = Tragwerk
Dämmung = Dämmung
Belüftet = Belüftet
Dach = Dach
Dachüberstand = Dachüberstand
WWR_Nord = WWR_Nord
WWR_Ost = WWR_Ost
WWR_Süd = WWR_Süd
WWR_West = WWR_West
Seitenverhältnis_y_x = Seitenverhältnis_y_x
Dachneigung = Dachneigung
Fundamenttiefe= Fundamenttiefe
# ---------- end python_2 ----------
ladybug = Ladybug_Ladybug()  # -> Vviiiiiiiiiizzz; disabled; plug-in component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
brep = Brep()  # disabled
panel_8 = Panel("http://climate.onebuilding.org/WMO_Region_4_North_and_Central_America/USA_United_States_of_America/NC_North_Carolina/USA_NC_Charlotte.Douglas.Intl.AP.723140_TMY3.zip")  # disabled
panel_9 = Panel(python_2.Temperatur)
panel_10 = Panel(python_2.Feuchtigkeit)
downloadepw = LBDownloadWeather(weather_URL=panel_3)  # -> epw_file, stat_file, ddy_file; disabled; plug-in component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
srf = Surface(<surface referenced from the Rhino model>)  # disabled
ziel_m² = Slider(40, range=0..100)
downloadepw_2 = LBDownloadWeather(weather_URL=panel_8)  # -> epw_file, stat_file, ddy_file; disabled; plug-in component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
debrep = DeconstructBrep(Brep=brep)  # -> Faces, Edges, Vertices; disabled
flip = Flip(Surface=debrep.Faces)  # -> Surface, Result; disabled
num = Number(python_2.Seitenverhältnis_y_x)
toggle = BooleanToggle(True)  # disabled
division = Division(A=python_2.Dämmung, B="100")
importepw = LBImportEPW(epw_file=downloadepw_2.epw_file)  # -> location, dry_bulb_temperature, dew_point_temperature, relative_humidity, wind_speed, wind_direction, direct_normal_rad, diffuse_horizontal_rad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; disabled; plug-in component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
python_3 = GhPythonScript(seitenverhältnis_y_x=num, grundrissfläche=ziel_m²)  # -> x, y
# ---------- python_3: Python ----------
__author__ = "mfls"
__version__ = "2024.06.07"

import rhinoscriptsyntax as rs

def calculate_dimensions(seitenverhältnis_y_x, area):
    """
    Berechnet die Dimensionen x und y eines Rechtecks basierend auf dem Seitenverhältnis y/x und der Grundrissfläche.

    Args:
    y_x_ratio (float): Das Seitenverhältnis y/x.
    area (float): Die gewünschte Grundrissfläche.

    Returns:
    tuple: Die berechneten Werte für x und y.
    """
    # y = ratio * x
    # area = x * y
    # area = x * (y_x_ratio * x)
    # area = y_x_ratio * x^2
    # x^2 = area / y_x_ratio
    # x = sqrt(area / y_x_ratio)
    
    import math
    x = math.sqrt(area / seitenverhältnis_y_x)
    y = seitenverhältnis_y_x * x
    
    return x, y

# Beispielhafte Verwendung
seitenverhältnis_y_x = seitenverhältnis_y_x
area = grundrissfläche
# Berechne x und y
x, y = calculate_dimensions(seitenverhältnis_y_x, area)

# Setze die Ausgaben für Grasshopper
x = x
y = y
# ---------- end python_3 ----------
tof = Ladybug_TiltAndOrientationFactor(
    epwFile=downloadepw.epw_file,
    PV_SWHsurface=srf,
    annualShading=0,
    north=0,
    precision=2,
    scale=1,
    bakeIt=False,
    runIt=toggle)  # -> readMe, port, TOF, TSRF, PVsurfaceTilt, PVsurfaceAzimuth, optimalTilt, optimalAzimuth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; disabled; plug-in component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
tmatch = MatchText(Text=python_2.Tragwerk, Pattern="Holz", Case=True)
tmatch_2 = MatchText(Text=python_2.Dach, Pattern="Flachdach", Case=True)
rectangle = Rectangle(Plane=PlaneXY(0, 0, 0), XSize=python_3.x, YSize=python_3.y, Radius=0)  # -> Rectangle, Length
decnstrloc = LBDeconstructLocation(location=importepw.location)  # -> name, latitude, longitude, time_zone, elevation; disabled; plug-in component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
skymatrix = LBCumulativeSkyMatrix(location=importepw.location, direct_rad=importepw.direct_normal_rad, diffuse_rad=importepw.diffuse_horizontal_rad)  # -> report, sky_mtx; disabled; plug-in component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
toggle_2 = BooleanToggle(True)  # disabled
number_slider = Slider(0.5, range=0.1..1)  # disabled
bool = Boolean(tmatch)
num_2 = Number(division)
bool_2 = Boolean(python_2.Belüftet)
bool_3 = Boolean(tmatch_2)

richtung_eingang_0_360 = Slider(90, range=0..360)
breitengrad = Slider(10, range=-90..90)
längengrad = Slider(22.5, range=-90..90)
raumhöhe = Slider(3, range=2.5..4)
raumhöhe_2 = GetNumber(raumhöhe, AtLeast=1, AtMost=1, Maximum=1.797693135e+308, Minimum=-1.797693135e+308, TreeAccess=False)
breitengrad_2 = GetNumber(
    breitengrad,
    AtLeast=1,
    AtMost=1,
    Maximum=1.797693135e+308,
    Minimum=-1.797693135e+308,
    Prompt="Breitengrad",
    TreeAccess=False)
dachform = GetString("Satteldach", AtLeast=1, AtMost=1, Prompt="Dachform", TreeAccess=False)
längengrad_2 = GetNumber(
    längengrad,
    AtLeast=1,
    AtMost=1,
    Maximum=1.797693135e+308,
    Minimum=-1.797693135e+308,
    Prompt="Längengrad",
    TreeAccess=False)
panel_11 = Panel(dachform)
num_3 = Number(raumhöhe_2)
panel_12 = Panel("Ist Schrägdach gewollt?")
tmatch_3 = MatchText(Text=panel_11, Pattern="Satteldach", Case=True)
bool_4 = Boolean(tmatch_3)
panel_13 = Panel("C:\Users\mfls\OneDrive\Uni\Master\Code\Tinyhouse Generator\files\EpwZipUrls.csv")
bool_5 = Boolean(bool_3)
p_n_c = PickNChoose(Pattern=bool_5, Stream0=bool_4, Stream1=Toggle(False))
python_4 = GhPythonScript(csv_path=panel_13, target_lat=längengrad_2, target_lon=breitengrad_2)  # -> nearest_station_url, shortest_distance; same code as python
bool_6 = Boolean(p_n_c)
panel_14 = Panel(python_4.nearest_station_url)
num_4 = Number(python_4.shortest_distance)
panel_15 = Panel(num_4)

num_5 = Number(python_2.Dachüberstand)
num_6 = Number(python_2.WWR_Nord)
num_7 = Number(python_2.WWR_Ost)
num_8 = Number(python_2.WWR_Süd)
num_9 = Number(python_2.WWR_West)
crv = Curve(rectangle.Rectangle)
num_10 = Number(python_2.Dachneigung)
num_11 = Number(python_2.Fundamenttiefe)
panel_16 = Panel(tof.optimalRadiation)  # disabled
panel_17 = Panel(tof.optimalAzimuth)  # disabled
panel_18 = Panel(tof.optimalTilt)  # disabled
panel_19 = Panel(decnstrloc.name)  # disabled
panel_20 = Panel(decnstrloc.latitude)  # disabled
panel_21 = Panel(decnstrloc.longitude)  # disabled
panel_22 = Panel("WWR Nord")
panel_23 = Panel(num_6)
panel_24 = Panel("WWR Ost")
panel_25 = Panel(num_7)
panel_26 = Panel("WWR Süd")
panel_27 = Panel(num_8)
panel_28 = Panel("WWR West")
panel_29 = Panel(num_9)
colour_swatch = ColourSwatch(SwatchColor=RGB(255, 255, 255))
colour_swatch_2 = ColourSwatch(SwatchColor=RGB(176, 176, 176))
panel_30 = Panel("Beton")
panel_31 = Panel("Holz")
colour_swatch_3 = ColourSwatch(SwatchColor=RGB(0, 0, 0))
panel_32 = Panel("Dämmung")
panel_33 = Panel("Abdichtung")
panel_34 = Panel("Putz")
panel_35 = Panel("Ziegel")
panel_36 = Panel("Außenwand")
panel_37 = Panel("Metall")
colour_swatch_4 = ColourSwatch(SwatchColor=RGB(204, 204, 204))
colour_swatch_5 = ColourSwatch(SwatchColor=RGB(245, 206, 152))
colour_swatch_6 = ColourSwatch(SwatchColor=RGB(221, 232, 21))
panel_38 = Panel("Glas")
colour_swatch_7 = ColourSwatch(SwatchColor=RGB(30, 45, 74))
colour_swatch_8 = ColourSwatch(SwatchColor=RGB(176, 176, 176))
colour_swatch_9 = ColourSwatch(SwatchColor=RGB(224, 224, 224))
area = Area(Geometry=crv)  # -> Area, Centroid
create_material = CreateMaterial(
    Diffuse=colour_swatch_4,
    Specular=RGB(255, 255, 255),
    Emission=RGB(0, 0, 0),
    Transparency=0,
    Shine=Slider(0, range=0..100))
create_material_2 = CreateMaterial(
    Diffuse=colour_swatch_5,
    Specular=RGB(255, 255, 255),
    Emission=RGB(0, 0, 0),
    Transparency=0,
    Shine=Slider(10, range=0..100))
create_material_3 = CreateMaterial(
    Diffuse=colour_swatch_6,
    Specular=RGB(255, 255, 255),
    Emission=RGB(0, 0, 0),
    Transparency=0,
    Shine=Slider(0, range=0..100))
create_material_4 = CreateMaterial(
    Diffuse=colour_swatch_3,
    Specular=RGB(255, 255, 255),
    Emission=RGB(0, 0, 0),
    Transparency=0,
    Shine=Slider(4, range=0..100))
create_material_5 = CreateMaterial(
    Diffuse=colour_swatch_7,
    Specular=RGB(255, 255, 255),
    Emission=RGB(0, 0, 0),
    Transparency=0,
    Shine=Slider(16, range=0..100))
create_material_6 = CreateMaterial(
    Diffuse=colour_swatch_8,
    Specular=RGB(255, 255, 255),
    Emission=RGB(0, 0, 0),
    Transparency=0,
    Shine=Slider(0, range=0..100))
create_material_7 = CreateMaterial(
    Diffuse=colour_swatch_2,
    Specular=RGB(255, 255, 255),
    Emission=RGB(0, 0, 0),
    Transparency=0,
    Shine=Slider(2, range=0..100))
create_material_8 = CreateMaterial(
    Diffuse=colour_swatch_9,
    Specular=RGB(255, 255, 255),
    Emission=RGB(0, 0, 0),
    Transparency=0,
    Shine=Slider(0, range=0..100))
create_material_9 = CreateMaterial(Diffuse=colour_swatch, Specular=RGB(255, 255, 255), Emission=RGB(0, 0, 0), Transparency=Slider(0.8, range=0..1), Shine=0)
offset = OffsetCurve(Curve=crv, Distance="0.5", Corners=1)
dom = ConstructDomain(DomainStart="0", DomainEnd="360")
dom_2 = ConstructDomain(DomainStart="0", DomainEnd="1")
num_12 = Number(richtung_eingang_0_360)
remap = RemapNumbers(Value=num_12, Source=dom, Target=dom_2)  # -> Mapped, Clipped
xy = XYPlane(Origin=area.Centroid)
cir = Circle(Plane=area.Centroid, Radius=area.Area)
flip_2 = FlipCurve(Curve=cir)  # -> Curve, Flag
rad = Radians(Degrees="90")
rotate = Rotate(Geometry=flip_2.Curve, Angle=rad, Plane=xy)  # -> Geometry, Transform
eval = EvaluateCurve(Curve=reparameterize(rotate.Geometry), Parameter=remap.Mapped)  # -> Point, Tangent, Angle
crv_cp = CurveClosestPoint(Point=eval.Point, Curve=offset)  # -> Point, Parameter, Distance
panel_39 = Panel("Form Vorschlag")
panel_40 = Panel("Richtung Eingang")
roominstance = RoomInstance()
crv_2 = Curve(crv)
pt = Point(crv_cp.Point)
roominstance_2 = RoomInstance()
roominstance_3 = RoomInstance()
roominstance_4 = RoomInstance()
area_2 = Area(Geometry=crv_2)  # -> Area, Centroid
panel_41 = Panel(area_2.Area)
houseinstance = HouseInstance(Boundary=crv_2, EntrancePoint=pt)
magnetizing_fpg = MagnetizingRooms_ES(
    HouseInstance=houseinstance,
    Iterations=Slider(900, range=0..1000),
    MaxAdjDistance=Slider(3, range=0..10),
    CellSizeM=Slider(0.8, range=0..1))  # -> Corridors, RoomBreps, RoomNames, Adjacencies, MissingAdjacences, Boundary, BoundaryOffset
pt_2 = Point(Point(-7.407236404, -0.0234716752, 0))
compass = LBCompass(center=pt_2, scale=Slider(0.2, range=0..1))  # -> compass; plug-in component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
brep_2 = Brep(magnetizing_fpg.Corridors)
brep_3 = Brep(magnetizing_fpg.RoomBreps)
join = BrepJoin(Breps=flatten([brep_2, brep_3]))  # -> Breps, Closed
cluster = Cluster(
    brep_2=magnetizing_fpg.Corridors,
    brep=magnetizing_fpg.RoomBreps,
    txt_2=magnetizing_fpg.RoomNames,
    txt=magnetizing_fpg.Adjacencies,
    int=magnetizing_fpg.MissingAdjacences,
    crv=magnetizing_fpg.Boundary,
    crv_2=magnetizing_fpg.BoundaryOffset)
edges = BrepEdges(Brep=join.Breps)  # -> Naked, Interior, NonManifold
join_2 = JoinCurves(Curves=edges.Naked, Preserve=False)
area_3 = Area(Geometry=join_2)  # -> Area, Centroid
cls = Closed(Curve=join_2)  # -> Closed, Periodic
crv_3 = Curve(join_2)
panel_42 = Panel(cls.Closed)
panel_43 = Panel(area_3.Area)
simplify = SimplifyCurve(Curve=crv_3)  # -> Curve, Simplified
# Auswahl Bauweise Aus CSV
flip_3 = FlipCurve(Curve=simplify.Curve)  # -> Curve, Flag
bool_7 = Boolean(bool)
dispatch = Dispatch(List=flip_3.Curve, DispatchPattern=bool_7)  # -> ListA, ListB
panel_44 = Panel("Kurve Original Grundriss")
crv_4 = Curve(flip_3.Curve)
Z = UnitZ(Factor=1)
debrep_2 = DeconstructBrep(Brep=crv_4)  # -> Faces, Edges, Vertices
md_slider = MDSlider(SliderMode=0, slider_value=Point(0.5, 0.5, 0.5), x_domain=Domain(0, 1), y_domain=Domain(0, 1), z_domain=Domain(0, 1))
extr = Extrude(Base=debrep_2.Edges, Direction=Z)
evalsrf = EvaluateSurface(Surface=reparameterize(extr), Point=md_slider)  # -> Point, Normal, UDirection, VDirection, Frame
xy_2 = XYPlane(Origin=Point(0, 0, 0))
Y = UnitY(Factor=1)
panel_45 = Panel("Text Raumname")
angle = Angle(VectorA=evalsrf.Normal, VectorB=Y, Plane=xy_2)  # -> Angle, Reflex
panel_47 = Panel("Eingangspunkt")
txt_2 = Text(magnetizing_fpg.RoomNames)
panel_48 = Panel("Brep Räume")
crv_5 = Curve(flip_3.Curve)
deg = Degrees(Radians=angle.Angle)
pt_3 = Point(pt)
tmatch_4 = MatchText(Text=txt_2, Pattern="Schlafraum", Case=True)
tmatch_5 = MatchText(Text=txt_2, Pattern="Bad", Case=True)
brep_4 = Brep(magnetizing_fpg.RoomBreps)
debrep_3 = DeconstructBrep(Brep=crv_5)  # -> Faces, Edges, Vertices
cull = CullPattern(List=brep_4, CullPattern=tmatch_4)
cull_2 = CullPattern(List=brep_4, CullPattern=tmatch_5)

# ---- group: Norden
smaller = SmallerThan(FirstNumber=deg, SecondNumber="45")  # -> SmallerThan, OrEqualTo
larger = LargerThan(FirstNumber=deg, SecondNumber="315")  # -> LargerThan, OrEqualTo
or = GateOr(A=smaller.OrEqualTo, B=larger.LargerThan)
dispatch_2 = Dispatch(List=debrep_2.Edges, DispatchPattern=or)  # -> ListA, ListB
data = Data(dispatch_2.ListA)

# ---- group: Osten
smaller_2 = SmallerThan(FirstNumber=deg, SecondNumber="135")  # -> SmallerThan, OrEqualTo
larger_2 = LargerThan(FirstNumber=deg, SecondNumber="45")  # -> LargerThan, OrEqualTo
and = GateAnd(A=larger_2.LargerThan, B=smaller_2.OrEqualTo)
dispatch_3 = Dispatch(List=debrep_2.Edges, DispatchPattern=and)  # -> ListA, ListB
data_2 = Data(dispatch_3.ListA)

# ---- group: Westen
larger_3 = LargerThan(FirstNumber=deg, SecondNumber="225")  # -> LargerThan, OrEqualTo
smaller_3 = SmallerThan(FirstNumber=deg, SecondNumber="315")  # -> SmallerThan, OrEqualTo
and_2 = GateAnd(A=larger_3.LargerThan, B=smaller_3.OrEqualTo)
dispatch_4 = Dispatch(List=debrep_2.Edges, DispatchPattern=and_2)  # -> ListA, ListB
data_3 = Data(dispatch_4.ListA)

# ---- group: Süden
larger_4 = LargerThan(FirstNumber=deg, SecondNumber="135")  # -> LargerThan, OrEqualTo
smaller_4 = SmallerThan(FirstNumber=deg, SecondNumber="225")  # -> SmallerThan, OrEqualTo
and_3 = GateAnd(A=larger_4.LargerThan, B=smaller_4.OrEqualTo)
dispatch_5 = Dispatch(List=debrep_2.Edges, DispatchPattern=and_3)  # -> ListA, ListB
data_4 = Data(dispatch_5.ListA)

# ----
merge = Merge(Data1=cull, Data2=cull_2)
edges_2 = BrepEdges(Brep=merge)  # -> Naked, Interior, NonManifold
join_3 = JoinCurves(Curves=edges_2.Naked, Preserve=False)
breite_tür_und_rahmen = Number(Slider(2, range=0..2))
simplify_2 = SimplifyCurve(Curve=join_3)  # -> Curve, Simplified
crv_6 = Curve(simplify_2.Curve)
explode = Explode(Curve=crv_6, Recursive=True)  # -> Segments, Vertices
panel_49 = Panel("Grundriss Kurve")
midpt = CurveMiddle(Curve=explode.Segments)
crv_7 = Curve(simplify.Curve)
crv_cp_2 = CurveClosestPoint(Point=midpt, Curve=crv_7)  # -> Point, Parameter, Distance
larger_5 = LargerThan(FirstNumber=crv_cp_2.Distance, SecondNumber="0.01")  # -> LargerThan, OrEqualTo
cull_3 = CullPattern(List=explode.Segments, CullPattern=larger_5.LargerThan)
wo_tür = Slider(0.5, range=0..1)
num_13 = Number(num_6)
num_14 = Number(num_8)
num_15 = Number(num_9)
num_16 = Number(num_7)
end = EndPoints(Curve=cull_3)  # -> Start, End
Z_2 = UnitZ(Factor=1)
crv_8 = Curve(cull_3)
# Weiterleitung an Fenster Cut
pt_4 = Point([end.Start, end.End])
md_slider_2 = MDSlider(SliderMode=0, slider_value=Point(0.5, 0.5, 0.5), x_domain=Domain(0, 1), y_domain=Domain(0, 1), z_domain=Domain(0, 1))
bang = ExplodeTree(Data=crv_8)  # -> _000000, _000100
midpt_2 = CurveMiddle(Curve=crv_8)  # -> graft(Midpoint)
breite_tür = Slider(1, range=0..1)
höhe_tür = Slider(2, range=0..2)
bang_2 = ExplodeTree(Data=crv_8)  # -> _000000, _000100
crv_cp_3 = CurveClosestPoint(Point=midpt_2, Curve=bang._000000)  # -> Point, Parameter, Distance
crv_cp_4 = CurveClosestPoint(Point=midpt_2, Curve=bang_2._000100)  # -> Point, Parameter, Distance
bnd = Bounds(Numbers=crv_cp_3.Distance)
panel_50 = Panel("Daten Fensterfläche")
bnd_2 = Bounds(Numbers=crv_cp_4.Distance)
multiplication = Multiplication(A=breite_tür, B="-0.5")
dedomain = DeconstructDomain(Domain=bnd)  # -> Start, End
dedomain_2 = DeconstructDomain(Domain=bnd_2)  # -> Start, End
trim = TrimTree(Tree=dedomain.Start, Depth=1)
panel_51 = Panel("Dicke Wandaufbau gesamt")
trim_2 = TrimTree(Tree=dedomain_2.Start, Depth=1)
equals = Equality(FirstNumber=trim, SecondNumber="0")  # -> Equality, Inequality
panel_52 = Panel("Output Data Metall")
panel_53 = Panel("Output Data Glas")
equals_2 = Equality(FirstNumber=trim_2, SecondNumber="0")  # -> Equality, Inequality
cull_4 = CullPattern(List=crv_8, CullPattern=equals.Inequality)
cull_5 = CullPattern(List=crv_8, CullPattern=equals_2.Inequality)
panel_55 = Panel("Türhöhe")
num_17 = Number(höhe_tür)
equals_3 = Equality(FirstNumber=[cull_5, cull_4], SecondNumber=crv_8)  # -> Equality, Inequality
Z_3 = UnitZ(Factor=num_17)
cull_6 = CullPattern(List=crv_8, CullPattern=equals_3.Inequality)
panel_56 = Panel("Innere Ecken Oben")
panel_57 = Panel("Innere Ecken Unten")
len = Length(Curve=flatten(cull_6))
bnd_3 = Bounds(Numbers=len)
panel_58 = Panel("Äußere Ecken Oben")
panel_59 = Panel("Äußere Ecken Unten")
dedomain_3 = DeconstructDomain(Domain=bnd_3)  # -> Start, End
equals_4 = Equality(FirstNumber=dedomain_3.End, SecondNumber=cull_6)  # -> Equality, graft(Inequality)
cull_7 = CullPattern(List=cull_6, CullPattern=equals_4.Inequality)
merge_2 = Merge(Data1=cull_5, Data2=cull_4, Data3=cull_7)
panel_60 = Panel("Tangente Vektor")
panel_61 = Panel("Unten")
panel_62 = Panel("Oben")
panel_63 = Panel("1")
panel_64 = Panel("2")
panel_65 = Panel("Dicke Fußplatte")
crv_9 = Curve(merge_2)
panel_67 = Panel("Raumhöhe")
dicke_rahmen = Slider(0.05, range=0..0.1)
join_4 = JoinCurves(Curves=merge_2, Preserve=False)
number_slider_2 = Slider(0.01, range=0..0.01)
len_2 = Length(Curve=crv_9)
breite_tür_und_rahmen_2 = Number(Slider(0.9, range=0..2))
larger_6 = LargerThan(FirstNumber=len_2, SecondNumber=breite_tür_und_rahmen_2)  # -> LargerThan, OrEqualTo
panel_69 = Panel("Logik Dachform Wechsel")
panel_70 = Panel("Unten-> Walmdach")
Z_4 = UnitZ(Factor=number_slider_2)
neg = Negative(Value=dicke_rahmen)
panel_72 = Panel("Oben -> Flachdach")
panel_73 = Panel("Dicke Rahmen")
cull_8 = CullPattern(List=crv_9, CullPattern=larger_6.LargerThan)
number_slider_3 = Slider(0.1, range=0..0.1)

# ---- group: Türplatzierung ohne Innenwand
panel_76 = Panel("Dicke Wandaufbau Innenände")
panel_77 = Panel("Punkte Innenwände")
pt_5 = Point(pt_4)
num_18 = Number(number_slider_3)
sph = Sphere(Base=pt_5, Radius=num_18)
trim_3 = TrimWithBreps(Curve=debrep_3.Edges, Brep=flatten(sph))  # -> Inside, Outside
crv_10 = Curve(flatten(trim_3.Outside))
panel_78 = Panel(crv_10)

# ----
len_3 = Length(Curve=crv_10)
larger_7 = LargerThan(FirstNumber=len_3, SecondNumber=breite_tür_und_rahmen)  # -> LargerThan, OrEqualTo
cull_9 = CullPattern(List=crv_10, CullPattern=larger_7.LargerThan)
crv_cp_5 = CurveClosestPoint(Point=pt_3, Curve=cull_9)  # -> Point, Parameter, Distance
bnd_4 = Bounds(Numbers=crv_cp_5.Distance)
dedomain_4 = DeconstructDomain(Domain=bnd_4)  # -> Start, End
equals_5 = Equality(FirstNumber=crv_cp_5.Distance, SecondNumber=dedomain_4.Start)  # -> Equality, Inequality
cull_10 = CullPattern(List=cull_9, CullPattern=equals_5.Equality)
extr_2 = Extrude(Base=cull_10, Direction=Z_2)
eval_2 = EvaluateCurve(Curve=reparameterize(cull_10), Parameter=wo_tür)  # -> Point, Tangent, Angle
evalsrf_2 = EvaluateSurface(Surface=reparameterize(extr_2), Point=md_slider_2)  # -> Point, Normal, UDirection, VDirection, Frame
pt_6 = Point(eval_2.Point)
vec = Vector(eval_2.Tangent)
pl = ConstructPlane(Origin=pt_6, XAxis=vec, YAxis=evalsrf_2.Normal)
multiplication_2 = Multiplication(A=vec, B=multiplication)
vec_2 = Vector(evalsrf_2.Normal)
pt_7 = Point(pt_6)
vec_3 = Vector(vec)
multiplication_3 = Multiplication(A=vec_3, B="0.5")
multiplication_4 = Multiplication(A=vec_3, B="-0.5")
move = Move(Geometry=pt_7, Motion=multiplication_3)  # -> Geometry, Transform
move_2 = Move(Geometry=pt_7, Motion=multiplication_4)  # -> Geometry, Transform
move_3 = Move(Geometry=move_2.Geometry, Motion=Z_3)  # -> Geometry, Transform
move_4 = Move(Geometry=move.Geometry, Motion=Z_3)  # -> Geometry, Transform
vec_4 = Vector(vec)
move_5 = Move(Geometry=move_2.Geometry, Motion=Z_4)  # -> Geometry, Transform
move_6 = Move(Geometry=move.Geometry, Motion=Z_4)  # -> Geometry, Transform
multiplication_5 = Multiplication(A=vec_4, B=dicke_rahmen)
vec_5 = Vector(multiplication_5)
rev = Reverse(Vector=vec_5)
num_19 = Number(number_slider_2)
num_20 = Number(dicke_rahmen)
move_7 = Move(Geometry=move_6.Geometry, Motion=rev)  # -> Geometry, Transform
move_8 = Move(Geometry=move_5.Geometry, Motion=vec_5)  # -> Geometry, Transform
num_21 = Number(höhe_tür)
clean = CleanTree(RemoveNulls=True, RemoveInvalid=True, RemoveEmpty=Toggle(True), Tree=cull_8)
addition = Addition(A=num_19, B=num_20)
subtraction = Subtraction(A=num_21, B=addition)
Z_5 = UnitZ(Factor=1)
panel_79 = Panel("Türblatt Grundform")
höhe_tür_2 = Slider(2, range=0..2)
breite_tür_2 = Slider(0.8, range=0..1)
extr_3 = Extrude(Base=clean, Direction=Z_5)
md_slider_3 = MDSlider(SliderMode=0, slider_value=Point(0.5, 0.5, 0.5), x_domain=Domain(0, 1), y_domain=Domain(0, 1), z_domain=Domain(0, 1))
eval_3 = EvaluateCurve(Curve=reparameterize(clean), Parameter="0.5")  # -> Point, Tangent, Angle
Z_6 = UnitZ(Factor=subtraction)
evalsrf_3 = EvaluateSurface(Surface=reparameterize(extr_3), Point=md_slider_3)  # -> Point, Normal, UDirection, VDirection, Frame
pt_8 = Point(eval_3.Point)
vec_6 = Vector(eval_3.Tangent)
move_9 = Move(Geometry=move_8.Geometry, Motion=Z_6)  # -> Geometry, Transform
move_10 = Move(Geometry=move_7.Geometry, Motion=Z_6)  # -> Geometry, Transform
pline = PolyLine(Vertices=[move_8.Geometry, move_7.Geometry, move_10.Geometry, move_9.Geometry], Closed=Toggle(True))
fpatch = FragmentPatch(Boundary=pline)
multiplication_6 = Multiplication(A=breite_tür_2, B="-0.5")
pl_2 = ConstructPlane(Origin=pt_8, XAxis=vec_6, YAxis=evalsrf_3.Normal)
panel_83 = Panel("Normal Vektor Wand")
panel_84 = Panel("Dicke Innenwand")
vec_7 = Vector(evalsrf_2.Normal)
multiplication_7 = Multiplication(A=vec_6, B=multiplication_6)
num_22 = Number(number_slider_3)
rectangle_2 = Rectangle(Plane=pl_2, XSize=breite_tür_2, YSize=num_22, Radius=0)  # -> Rectangle, Length
move_11 = Move(Geometry=rectangle_2.Rectangle, Motion=multiplication_7)  # -> Geometry, Transform
md_slider_4 = MDSlider(
    SliderMode=0,
    slider_value=Point(0.4426410044, 0.2189917471, 0.5),
    x_domain=Domain(0, 1),
    y_domain=Domain(0, 1),
    z_domain=Domain(0, 1))
boxrec = BoxRectangle(Rectangle=move_11.Geometry, Height=höhe_tür_2)  # -> flatten(Box)
number_slider_4 = Slider(0.02, range=0..0.1)
panel_85 = Panel("Output Data Holz")
neg_2 = Negative(Value=number_slider_4)
panel_86 = Panel("Output Data Putz")
# Logik Dicke zweite Dämmschicht Holz
panel_88 = Panel("Dämmstärke aus CSV")
dicke_diffusionsoffene_schicht = Slider(0.011, range=0.011..0.02)
dicke_latte_luftschicht = Slider(0.05, range=0..0.8)
dicke_osb = Slider(0.02, range=0.01..0.02)
dicke_gipskarton = Slider(0.02, range=0.01..0.02)
dicke_innenputz = Slider(0.02, range=0..0.02)
y_holzständer = Slider(0.2, range=0..0.8)
x_holzständer = Slider(0.06, range=0..0.5)
grundriss = Curve(dispatch.ListA)
raumhöhe_3 = Number(num_3)
num_23 = Number(raumhöhe_3)
Z_7 = UnitZ(Factor=num_23)
dispatch_6 = Dispatch(List=Z_7, DispatchPattern=bool_3)  # -> ListA, ListB
extr_4 = Extrude(Base=join_4, Direction=dispatch_6.ListA)
offsetbrep = OffsetBrep(Brep=extr_4, OffsetDistance=Slider(0.1, range=0..0.1), Solid=Toggle(True), SharpEdges=True, Tolerance=0.01)
join_5 = BrepJoin(Breps=flatten(offsetbrep))  # -> Breps, Closed
# Dach Brep Unterseite
# Verteilung
panel_89 = Panel("""Raumhöhe
Verteilung""")
panel_90 = Panel("Dach Brep Unterseite")
panel_91 = Panel("Dicke Dämmschicht CSV")
dicke_außenputz = Slider(0.02, range=0.01..0.02)
dicke_innenputz_2 = Slider(0.02, range=0..0.02)
dicke_wand = Slider(0.2, range=0.1..0.4)
dicke_abdichtung = Slider(0.011, range=0.011..0.02)
dicke_innenputz_3 = Number(dicke_innenputz)
dicke_latte_luftschicht_2 = Number(dicke_latte_luftschicht)
dicke_diffusionsoffene_schicht_2 = Number(dicke_diffusionsoffene_schicht)
dicke_gk = Number(dicke_gipskarton)
dicke_wand_2 = Number(y_holzständer)
num_24 = Number(dicke_wand_2)
subtraction_2 = Subtraction(A=num_2, B=num_24)
smaller_5 = SmallerThan(FirstNumber=subtraction_2, SecondNumber="0")  # -> SmallerThan, OrEqualTo
p_n_c_2 = PickNChoose(Pattern=smaller_5.OrEqualTo, Stream0=subtraction_2, Stream1="0")
num_25 = Number(p_n_c_2)
dicke_zweite_dämmschicht = Number(num_25)
num_26 = Number(x_holzständer)
dicke_osb_2 = Number(dicke_osb)
num_27 = Number(num_2)
raumhöhe_4 = Number(num_3)
num_28 = Number(raumhöhe_4)
Z_8 = UnitZ(Factor=num_28)
dispatch_7 = Dispatch(List=Z_8, DispatchPattern=bool_3)  # -> ListA, ListB
extr_5 = Extrude(Base=join_4, Direction=dispatch_7.ListB)
crv_11 = Curve(dispatch.ListB)

# ---- group: Logik Wanddicken
# Boolean Switch Holz Stein
# Boolean Switch Holz Stein
# Boolean Switch Holz Stein
# Boolean Switch Holz Stein
# Dicke zweite Dämmschicht Holz
# Boolean Switch Holz Stein
# Boolean Switch Holz Stein
# Dicke OSB + GK Holz
panel_92 = Panel("0")
panel_93 = Panel("Dicke Putz Massiv")
panel_94 = Panel("Dicke Abdichtung Massiv")
panel_95 = Panel("Dicke Diffusionsof. S. Holz")
panel_96 = Panel("Dicke Dämmschicht Massiv")
panel_97 = Panel("Dicke Luftschicht Massiv")
panel_98 = Panel("Dicke Luftschicht Holz")
panel_99 = Panel("Dicke Wand Massiv")
panel_100 = Panel("Dicke Holständer Holz")
panel_102 = Panel("Dicke Putz Holz")
data_5 = Data(dicke_osb_2)
data_6 = Data(dicke_außenputz)
data_7 = Data(dicke_gk)
addition_2 = Addition(A=data_5, B=data_7)
panel_103 = Panel("Dicke Wand Tragend")
panel_104 = Panel("Dicke Putz")
panel_105 = Panel("Dicke Abdichtung")
panel_106 = Panel("Dicke Aüßere Dämmschicht")
bool_8 = Boolean(bool_7)
bool_9 = Boolean(bool_7)
data_8 = Data(dicke_wand)
data_9 = Data(dicke_innenputz_2)
bool_10 = Boolean(bool_7)
panel_107 = Panel("Dicke Luftschicht")
data_10 = Data(dicke_wand_2)
data_11 = Data(dicke_abdichtung)
data_12 = Data(dicke_innenputz_3)
data_13 = Data(dicke_diffusionsoffene_schicht_2)
bool_11 = Boolean(bool_7)
data_14 = Data(num_27)
data_15 = Data(dicke_zweite_dämmschicht)
bool_12 = Boolean(bool_7)
data_16 = Data(panel_92)
data_17 = Data(dicke_latte_luftschicht_2)
panel_108 = Panel("Dicke Außenhaut")
panel_109 = Panel("Dicke Wandaufbau Gesamt")
bool_13 = Boolean(bool_7)
p_n_c_3 = PickNChoose(Pattern=bool_9, Stream0=data_9, Stream1=data_12)
p_n_c_4 = PickNChoose(Pattern=bool_8, Stream0=data_8, Stream1=data_10)
p_n_c_5 = PickNChoose(Pattern=bool_10, Stream0=data_11, Stream1=data_13)
p_n_c_6 = PickNChoose(Pattern=bool_11, Stream0=data_14, Stream1=data_15)
p_n_c_7 = PickNChoose(Pattern=bool_12, Stream0=data_16, Stream1=data_17)
p_n_c_8 = PickNChoose(Pattern=bool_13, Stream0=data_6, Stream1=addition_2)
data_18 = Data(p_n_c_3)
data_19 = Data(p_n_c_4)
data_20 = Data(p_n_c_5)
data_21 = Data(p_n_c_6)
data_22 = Data(p_n_c_7)
data_23 = Data(p_n_c_8)
ma = MassAddition(Input=[data_23, data_22, data_21, data_20, data_19, data_18])  # -> Result, PartialResults
data_24 = Data(ma.Result)

# ----
num_29 = Number(data_24)
rectangle_3 = Rectangle(Plane=pl, XSize=breite_tür, YSize=num_29, Radius=0)  # -> Rectangle, Length
move_12 = Move(Geometry=rectangle_3.Rectangle, Motion=multiplication_2)  # -> Geometry, Transform
num_30 = Number(num_29)
multiplication_8 = Multiplication(A=vec_2, B=num_30)
boxrec_2 = BoxRectangle(Rectangle=move_12.Geometry, Height=höhe_tür)
# Daten für Trim "Wo ist Tür"
data_25 = Data(boxrec_2)
trim_4 = TrimWithBreps(Curve=data_2, Brep=data_25)  # -> Inside, Outside
trim_5 = TrimWithBreps(Curve=data, Brep=data_25)  # -> Inside, Outside
trim_6 = TrimWithBreps(Curve=data_4, Brep=data_25)  # -> Inside, Outside
trim_7 = TrimWithBreps(Curve=data_3, Brep=data_25)  # -> Inside, Outside
crv_12 = Curve(trim_5.Outside)
crv_13 = Curve(trim_4.Outside)
crv_14 = Curve(trim_6.Outside)
crv_15 = Curve(trim_7.Outside)
fenster_generator = FensterGenerator(
    num_5=num_3,
    wwr_himmelsrichtung=num_13,
    kurven_himmelsrichtung=crv_12,
    num=num_29,
    pt=pt_4,
    num_2=number_slider_3,
    num_10=data_24)  # -> G, output_glas_2, output_fensterrahmen_2, B
fenster_generator_2 = FensterGenerator(
    num_5=num_3,
    wwr_himmelsrichtung=num_16,
    kurven_himmelsrichtung=crv_13,
    num=num_29,
    pt=pt_4,
    num_2=number_slider_3,
    num_10=data_24)  # -> G, output_glas_2, output_fensterrahmen_2, B
fenster_generator_3 = FensterGenerator(
    num_5=num_3,
    wwr_himmelsrichtung=num_14,
    kurven_himmelsrichtung=crv_14,
    num=num_29,
    pt=pt_4,
    num_2=number_slider_3,
    num_10=data_24)  # -> G, output_glas_2, output_fensterrahmen_2, B
fenster_generator_4 = FensterGenerator(
    num_5=num_3,
    wwr_himmelsrichtung=num_15,
    kurven_himmelsrichtung=crv_15,
    num=num_29,
    pt=pt_4,
    num_2=number_slider_3,
    num_10=data_24)  # -> G, output_glas_2, output_fensterrahmen_2, B
# Daten für Abzug Wand
data_26 = Data(flatten([boxrec_2, fenster_generator_3.B, fenster_generator.B, fenster_generator_2.B, fenster_generator_4.B]))
data_27 = Data([fenster_generator.G, fenster_generator_2.G, fenster_generator_3.G, fenster_generator_4.G])
null = NullItem(Item=data_27)  # -> NullFlags, InvalidFlags, Description
invbool = InvertBoolean(Boolean=null.NullFlags)  # -> Inverted, Number
cull_11 = CullPattern(List=data_27, CullPattern=invbool.Inverted)
data_28 = Data([fenster_generator.output_fensterrahmen_2, fenster_generator_2.output_fensterrahmen_2, fenster_generator_3.output_fensterrahmen_2, fenster_generator_4.output_fensterrahmen_2])
data_29 = Data([fenster_generator.output_glas_2, fenster_generator_2.output_glas_2, fenster_generator_3.output_glas_2, fenster_generator_4.output_glas_2])
data_30 = Data(data_29)
mcol = MeshColours(Mesh=data_30, Colours=colour_swatch)
mesh = Mesh(mcol)
custom_preview = CustomPreview(Geometry=data_30, Material=create_material_9)
data_31 = Data(cull_11)
panel_110 = Panel(cull_11)
move_13 = Move(Geometry=move.Geometry, Motion=multiplication_8)  # -> Geometry, Transform
move_14 = Move(Geometry=move_13.Geometry, Motion=Z_3)  # -> Geometry, Transform
move_15 = Move(Geometry=move_2.Geometry, Motion=multiplication_8)  # -> Geometry, Transform
move_16 = Move(Geometry=move_15.Geometry, Motion=Z_3)  # -> Geometry, Transform
pline_2 = PolyLine(Vertices=[move_3.Geometry, move_4.Geometry, move_14.Geometry, move_16.Geometry], Closed=Toggle(True))
pline_3 = PolyLine(Vertices=[move.Geometry, move_2.Geometry, move_15.Geometry, move_13.Geometry], Closed=Toggle(True))
pline_4 = PolyLine(Vertices=[move.Geometry, move_13.Geometry, move_14.Geometry, move_4.Geometry], Closed=Toggle(True))
pline_5 = PolyLine(Vertices=[move_15.Geometry, move_2.Geometry, move_3.Geometry, move_16.Geometry], Closed=Toggle(True))
fpatch_2 = FragmentPatch(Boundary=pline_2)
fpatch_3 = FragmentPatch(Boundary=pline_3)
fpatch_4 = FragmentPatch(Boundary=pline_4)
fpatch_5 = FragmentPatch(Boundary=pline_5)
join_6 = BrepJoin(Breps=[fpatch_2, fpatch_4, fpatch_5])  # -> Breps, Closed
offsetbrep_2 = OffsetBrep(Brep=join_6.Breps, OffsetDistance=neg, Solid=Toggle(True), SharpEdges=True, Tolerance=0.01)
extr_6 = Extrude(Base=fpatch_3, Direction=Z_4)
data_32 = Data([offsetbrep_2, extr_6])
num_31 = Number(num_29)
multiplication_9 = Multiplication(A=num_31, B=Slider(0.7, range=0..1))
multiplication_10 = Multiplication(A=vec_7, B=multiplication_9)
move_17 = Move(Geometry=fpatch, Motion=multiplication_10)  # -> Geometry, Transform
evalsrf_4 = EvaluateSurface(Surface=reparameterize(move_17.Geometry), Point=md_slider_4)  # -> Point, Normal, UDirection, VDirection, Frame
offsrf = OffsetSurface(Surface=move_17.Geometry, Distance=Slider(0.04, range=0..0.1), BothSides=0, CreateSolid=True)
pl_3 = ConstructPlane(Origin=evalsrf_4.Point, XAxis=evalsrf_4.VDirection, YAxis=evalsrf_4.UDirection)
data_33 = Data(offsrf)
cyl = Cylinder(Base=pl_3, Radius=number_slider_4, Length=number_slider_4)
multiplication_11 = Multiplication(A=evalsrf_4.Normal, B=neg_2)
move_18 = Move(Geometry=evalsrf_4.Point, Motion=multiplication_11)  # -> Geometry, Transform
sph_2 = Sphere(Base=move_18.Geometry, Radius=number_slider_4)
data_34 = Data([sph_2, cyl, data_32])
panel_111 = Panel("Kurve Dämmung")
panel_112 = Panel("""Kurve Dämmung
Hochgeschoben Ringbalken""")
# Grundriss nach Zweiter Dämmschicht
panel_113 = Panel("Dicke Latte Luftschicht")
höhe_ringbalken_unten = Slider(0.2, range=0..1)
panel_114 = Panel("Ringbalken Holz unten")
panel_116 = Panel("Grundriss Ganz innen")
panel_117 = Panel("Y Holzständer")
# Raumhöhe x 10 um Cutoff zu generieren
num_32 = Number(raumhöhe_4)
num_33 = Number(dicke_latte_luftschicht_2)
panel_119 = Panel("Grundriss nach Dämmung")
panel_120 = Panel("Grundriss nach Abdichtung")
panel_122 = Panel("Dicke Innenputz")
crv_16 = Curve(grundriss)
multiplication_12 = Multiplication(B="10")
panel_124 = Panel("Grundriss nach OSB")
num_34 = Number(raumhöhe_4)
crv_17 = Curve(crv_11)
# Raumhöhe x 10 um Cutoff zu generieren
panel_126 = Panel("Dicke Außenputz")
panel_127 = Panel("Innenputz")
# Raumhöhe x 10 um Cutoff zu generieren
panel_128 = Panel("Dicke Dämmung")
offset_2 = OffsetCurve(Curve=crv_16, Distance=dicke_innenputz_3, Corners=1)
edges_3 = BrepEdges(Brep=offset_2)  # -> Naked, Interior, NonManifold
len_4 = Length(Curve=edges_3.Naked)
crv_18 = Curve(offset_2)
divide = DivideCurve(Curve=edges_3.Naked, Count=len_4, Kinks=False)  # -> Points, Tangents, Parameters
offset_3 = OffsetCurve(Curve=crv_18, Distance=dicke_wand_2, Corners=1)
num_35 = Number(raumhöhe_4)
panel_129 = Panel("Kurve OSB")
# Grundriss nach tragender Wand
# Raumhöhe x 10 um Cutoff zu generieren
panel_130 = Panel("Dicke Abdichtung")
panel_131 = Panel("Dicke Zweite Dämmschicht")
num_36 = Number(raumhöhe_4)
Z_9 = UnitZ(Factor=multiplication_12)
Z_10 = UnitZ(Factor=num_34)
Z_11 = UnitZ(Factor=1)
Z_12 = UnitZ(Factor=1)
num_37 = Number(raumhöhe_4)
panel_134 = Panel("Dicke OSB")
offset_4 = OffsetCurve(Curve=crv_17, Distance=dicke_innenputz_2, Corners=1)
num_38 = Number(raumhöhe_4)
panel_135 = Panel("Außenputz")
multiplication_13 = Multiplication(B="10")
panel_136 = Panel("Grundriss nach Inneputz")
dicke_fußbodendämmung = Slider(0.12, range=0.12..0.25)
panel_139 = Panel("Zweite Dämmschicht")
multiplication_14 = Multiplication(B="10")
boundary = BoundarySurfaces(Edges=flatten([crv_18, offset_3]))
dispatch_8 = Dispatch(List=Z_10, DispatchPattern=bool_3)  # -> ListA, ListB
boundary_2 = BoundarySurfaces(Edges=flatten([crv_16, offset_2]))
# Randkure Innenputz
# für Bodenbelag beginn
dicke_bodenbelag = Slider(0.05, range=0..0.1)
multiplication_15 = Multiplication(B="10")
dicke_estrich = Slider(0.08, range=0.025..0.1)
panel_144 = Panel("Dicke Diff Schicht")
Z_13 = UnitZ(Factor=höhe_ringbalken_unten)
num_39 = Number(raumhöhe_4)
panel_145 = Panel("Außenhaut")
num_40 = Number(raumhöhe_4)
dicke_dampfsperre = Slider(0.01, range=0.005..0.01)
dicke_bodenplatte = Slider(0.3, range=0.25..0.5)
crv_19 = Curve(offset_3)
Z_14 = UnitZ(Factor=num_35)
panel_146 = Panel("Dach Brep")
num_41 = Number(raumhöhe_4)
Z_15 = UnitZ(Factor=raumhöhe_3)
boundary_3 = BoundarySurfaces(Edges=flatten([crv_17, offset_4]))
num_42 = Number(raumhöhe_4)
Z_16 = UnitZ(Factor=multiplication_13)
crv_20 = Curve(offset_2)
Z_17 = UnitZ(Factor=multiplication_14)
dispatch_9 = Dispatch(List=Z_9, DispatchPattern=bool_3)  # -> ListA, ListB
num_43 = Number(raumhöhe_4)
item = ListItem(List=divide.Points, Index="0", Wrap=True)
panel_152 = Panel("Dicke Wand")
Z_18 = UnitZ(Factor=multiplication_15)
Z_19 = UnitZ(Factor=num_39)
Z_20 = UnitZ(Factor=num_40)
crv_21 = Curve(offset_4)
# Grundriss vor tragender Wand
edges_4 = BrepEdges(Brep=crv_21)  # -> Naked, Interior, NonManifold
midpt_3 = CurveMiddle(Curve=edges_4.Naked)
line = LineSDL(Start=midpt_3, Direction=Z_11, Length=Slider(100000000, range=0..100000000))
Z_21 = UnitZ(Factor=1)
Z_22 = UnitZ(Factor=num_41)
offset_5 = OffsetCurve(Curve=crv_19, Distance=dicke_diffusionsoffene_schicht_2, Corners=1)
crv_22 = Curve(offset_5)
offset_6 = OffsetCurve(Curve=crv_22, Distance=dicke_zweite_dämmschicht, Corners=1)
crv_23 = Curve(offset_6)
offset_7 = OffsetCurve(Curve=crv_23, Distance=num_33, Corners=1)
edges_5 = BrepEdges(Brep=offset_7)  # -> Naked, Interior, NonManifold
boundary_4 = BoundarySurfaces(Edges=flatten([crv_22, offset_6]))
midpt_4 = CurveMiddle(Curve=edges_5.Naked)
extr_7 = Extrude(Base=boundary, Direction=Z_13)
Z_23 = UnitZ(Factor=num_42)
panel_155 = Panel("Gipskarton")
item_2 = ListItem(List=divide.Points, Index="0", Wrap=True)
item_3 = ListItem(List=divide.Tangents, Index="0", Wrap=True)
offset_8 = OffsetCurve(Curve=offset_7, Distance=dicke_osb_2, Corners=1)
crv_24 = Curve(offset_8)
offset_9 = OffsetCurve(Curve=crv_24, Distance=dicke_gk, Corners=1)
num_44 = Number(raumhöhe_4)
boundary_5 = BoundarySurfaces(Edges=flatten([crv_24, offset_9]))
Z_24 = UnitZ(Factor=num_43)
panel_156 = Panel("Tragende Wand")
panel_158 = Panel("Breite Latte")
num_45 = Number(raumhöhe_4)
dispatch_10 = Dispatch(List=Z_19, DispatchPattern=bool_3)  # -> ListA, ListB
offset_10 = OffsetCurve(Curve=crv_21, Distance=dicke_wand, Corners=1)
# Grundriss nach tragender Wand
edges_6 = BrepEdges(Brep=offset_10)  # -> Naked, Interior, NonManifold
midpt_5 = CurveMiddle(Curve=edges_6.Naked)
crv_25 = Curve(offset_10)
offset_11 = OffsetCurve(Curve=crv_25, Distance=dicke_abdichtung, Corners=1)
crv_26 = Curve(offset_11)
offset_12 = OffsetCurve(Curve=crv_26, Distance=num_27, Corners=1)
crv_27 = Curve(offset_12)
offset_13 = OffsetCurve(Curve=crv_27, Distance=dicke_außenputz, Corners=1)
line_2 = LineSDL(Start=midpt_5, Direction=Z_12, Length=Slider(100000000, range=0..100000000))
boundary_6 = BoundarySurfaces(Edges=flatten([crv_27, offset_13]))
boundary_7 = BoundarySurfaces(Edges=flatten([crv_26, offset_12]))
boundary_8 = BoundarySurfaces(Edges=flatten([crv_25, offset_11]))
move_19 = Move(Geometry=crv_20, Motion=Z_15)  # -> Geometry, Transform
dist = Distance(PointA=item, PointB=divide.Points)
dispatch_11 = Dispatch(List=Z_16, DispatchPattern=bool_3)  # -> ListA, ListB
dispatch_12 = Dispatch(List=Z_22, DispatchPattern=bool_3)  # -> ListA, ListB
dispatch_13 = Dispatch(List=Z_17, DispatchPattern=bool_3)  # -> ListA, ListB
panel_166 = Panel("Tür Rechteck")
dispatch_14 = Dispatch(List=Z_23, DispatchPattern=bool_3)  # -> ListA, ListB
dispatch_15 = Dispatch(List=Z_18, DispatchPattern=bool_3)  # -> ListA, ListB
Z_25 = UnitZ(Factor=num_44)
boundary_9 = BoundarySurfaces(Edges=flatten([crv_19, offset_5]))
Z_26 = UnitZ(Factor=num_45)
line_3 = LineSDL(Start=midpt_4, Direction=Z_21, Length=Slider(100000000, range=0..100000000))
align = AlignPlane(Plane=item_2, Direction=item_3)  # -> Plane, Angle
boundary_10 = BoundarySurfaces(Edges=flatten([offset_7, offset_8]))
extr_8 = Extrude(Base=boundary_3, Direction=dispatch_9.ListB)
breite_der_latte = Number(num_26)
extr_9 = Extrude(Base=boundary_3, Direction=dispatch_8.ListA)
bnd_5 = Bounds(Numbers=dist)
boundary_11 = BoundarySurfaces(Edges=flatten([crv_21, offset_10]))
fastsdiff = FastSolidDifference(
    SubtractFrom=graft(extr_7),
    SubtractWith=data_26,
    Tolerance=0.01,
    computeBBFastSolidDiff=True,
    retainFastSolidDiff=True,
    strictFastSolidDiff=True,
    trueIntFastSolidDiff=False)
num_46 = Number(raumhöhe_3)
extr_10 = Extrude(Base=boundary_6, Direction=dispatch_11.ListB)
extr_11 = Extrude(Base=boundary_7, Direction=dispatch_15.ListB)
extr_12 = Extrude(Base=boundary_8, Direction=dispatch_13.ListB)
Z_27 = UnitZ(Factor=num_46)
dedom2num = DeconstructDomain²(Domain=bnd_5)  # -> UMin, UMax, VMin, VMax
num_47 = Number(raumhöhe_3)
num_48 = Number(raumhöhe_4)
Z_28 = UnitZ(Factor=höhe_ringbalken_unten)
panel_182 = Panel("X Holzständer")

extr_13 = Extrude(Base=boundary_6, Direction=dispatch_10.ListA)
fastsdiff_2 = FastSolidDifference(
    SubtractFrom=graft(extr_13),
    SubtractWith=data_26,
    Tolerance=0.01,
    computeBBFastSolidDiff=True,
    retainFastSolidDiff=True,
    strictFastSolidDiff=True,
    trueIntFastSolidDiff=False)

incidentradiation = LBIncidentRadiation(
    sky_mtx=skymatrix.sky_mtx,
    geometry=flatten(data_31),
    context=flatten(fastsdiff_2),
    grid_size=number_slider,
    run=toggle_2)  # -> report, points, results, total, mesh, legend, title, int_mtx; disabled; plug-in component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
panel_184 = Panel(incidentradiation.results)  # disabled
panel_185 = Panel(incidentradiation.total)  # disabled
num_49 = Number(raumhöhe_3)
fastsdiff_3 = FastSolidDifference(
    SubtractFrom=graft(extr_9),
    SubtractWith=data_26,
    Tolerance=0.01,
    computeBBFastSolidDiff=True,
    retainFastSolidDiff=True,
    strictFastSolidDiff=True,
    trueIntFastSolidDiff=False)
extr_14 = Extrude(Base=boundary_4, Direction=Z_20)
extr_15 = Extrude(Base=boundary_5, Direction=Z_24)
dispatch_16 = Dispatch(List=Z_27, DispatchPattern=bool_3)  # -> ListA, ListB
extr_16 = Extrude(Base=boundary_8, Direction=dispatch_12.ListA)
Z_29 = UnitZ(Factor=num_47)
extr_17 = Extrude(Base=boundary_7, Direction=dispatch_14.ListA)
Z_30 = UnitZ(Factor=num_48)
subtraction_3 = Subtraction(A=dedom2num.UMax, B=breite_der_latte)
Z_31 = UnitZ(Factor=num_49)
extr_18 = Extrude(Base=boundary_9, Direction=Z_25)
num_50 = Number(raumhöhe_3)
move_20 = Move(Geometry=crv_18, Motion=Z_28)  # -> Geometry, Transform
edges_7 = BrepEdges(Brep=move_20.Geometry)  # -> Naked, Interior, NonManifold
len_5 = Length(Curve=edges_7.Naked)
divide_2 = DivideCurve(Curve=edges_7.Naked, Count=len_5, Kinks=False)  # -> Points, Tangents, Parameters
item_4 = ListItem(List=divide_2.Points, Index="0", Wrap=True)
item_5 = ListItem(List=divide_2.Tangents, Index="0", Wrap=True)
item_6 = ListItem(List=divide_2.Points, Index="0", Wrap=True)
align_2 = AlignPlane(Plane=item_4, Direction=item_5)  # -> Plane, Angle
dist_2 = Distance(PointA=item_6, PointB=divide_2.Points)
bnd_6 = Bounds(Numbers=dist_2)
num_51 = Number(raumhöhe_3)
dispatch_17 = Dispatch(List=Z_29, DispatchPattern=bool_3)  # -> ListA, ListB
dedom2num_2 = DeconstructDomain²(Domain=bnd_6)  # -> UMin, UMax, VMin, VMax
extr_19 = Extrude(Base=boundary_10, Direction=Z_26)
dispatch_18 = Dispatch(List=Z_30, DispatchPattern=bool_3)  # -> ListA, ListB
num_52 = Number(num_26)
extr_20 = Extrude(Base=boundary_2, Direction=Z_14)
Z_32 = UnitZ(Factor=num_50)
data_35 = Data(fastsdiff)
dispatch_19 = Dispatch(List=Z_31, DispatchPattern=bool_3)  # -> ListA, ListB
panel_200 = Panel("Dicke Latte Luftschicht")
dom_3 = ConstructDomain(DomainStart=0, DomainEnd=subtraction_3)
Z_33 = UnitZ(Factor=1)
Z_34 = UnitZ(Factor=num_51)
Z_35 = UnitZ(Factor=1)
extr_21 = Extrude(Base=boundary_2, Direction=dispatch_16.ListA)

fastsdiff_4 = FastSolidDifference(
    SubtractFrom=graft(extr_17),
    SubtractWith=data_26,
    Tolerance=0.01,
    computeBBFastSolidDiff=True,
    retainFastSolidDiff=True,
    strictFastSolidDiff=True,
    trueIntFastSolidDiff=False)

dispatch_20 = Dispatch(List=Z_32, DispatchPattern=bool_3)  # -> ListA, ListB
fastsdiff_5 = FastSolidDifference(
    SubtractFrom=graft(extr_16),
    SubtractWith=data_26,
    Tolerance=0.01,
    computeBBFastSolidDiff=True,
    retainFastSolidDiff=True,
    strictFastSolidDiff=True,
    trueIntFastSolidDiff=False)
subtraction_4 = Subtraction(A=dedom2num_2.UMax, B=num_52)
dispatch_21 = Dispatch(List=Z_34, DispatchPattern=bool_3)  # -> ListA, ListB
extr_22 = Extrude(Base=boundary_4, Direction=dispatch_17.ListA)
rectangle_4 = Rectangle(Plane=align.Plane, XSize=breite_der_latte, YSize=dicke_latte_luftschicht, Radius=0)  # -> Rectangle, Length
extr_23 = Extrude(Base=boundary_5, Direction=dispatch_19.ListA)
Z_36 = UnitZ(Factor=dicke_bodenbelag)
Z_37 = UnitZ(Factor=dicke_estrich)
Z_38 = UnitZ(Factor=dicke_fußbodendämmung)
remap_2 = RemapNumbers(Value=dist, Source=bnd_5, Target=dom_3)  # -> Mapped, Clipped
Z_39 = UnitZ(Factor=dicke_dampfsperre)
Z_40 = UnitZ(Factor=dicke_bodenplatte)
crv_28 = Curve(move_20.Geometry)
# Grundriss vor tragender Wand
edges_8 = BrepEdges(Brep=crv_28)  # -> Naked, Interior, NonManifold
midpt_6 = CurveMiddle(Curve=edges_8.Naked)
line_4 = LineSDL(Start=midpt_6, Direction=Z_33, Length=Slider(100000000, range=0..100000000))
dom_4 = ConstructDomain(DomainStart=0, DomainEnd=subtraction_4)
extr_24 = Extrude(Base=boundary_9, Direction=dispatch_20.ListA)
multiplication_16 = Multiplication(A=remap_2.Mapped, B=item_3)
# Frostsicheres Fundament mind 80cm
panel_224 = Panel("Dicke Wand")
panel_226 = Panel("Dicke Diffusionsoffene Schicht")
extr_25 = Extrude(Base=boundary_10, Direction=dispatch_21.ListA)
neg_3 = Negative(Value=Z_36)
neg_4 = Negative(Value=Z_37)
neg_5 = Negative(Value=Z_38)
neg_6 = Negative(Value=Z_39)
neg_7 = Negative(Value=Z_40)
offset_14 = OffsetCurve(Curve=crv_28, Distance=dicke_wand_2, Corners=1)
# Grundriss nach tragender Wand
edges_9 = BrepEdges(Brep=offset_14)  # -> Naked, Interior, NonManifold
midpt_7 = CurveMiddle(Curve=edges_9.Naked)
line_5 = LineSDL(Start=midpt_7, Direction=Z_35, Length=Slider(100000000, range=0..100000000))
fastsdiff_6 = FastSolidDifference(
    SubtractFrom=graft(extr_21),
    SubtractWith=data_26,
    Tolerance=0.01,
    computeBBFastSolidDiff=True,
    retainFastSolidDiff=True,
    strictFastSolidDiff=True,
    trueIntFastSolidDiff=False)
ma_2 = MassAddition(Input=[dicke_bodenbelag, dicke_estrich, dicke_fußbodendämmung, dicke_dampfsperre, dicke_bodenplatte])  # -> Result, PartialResults
move_21 = Move(Geometry=rectangle_4.Rectangle, Motion=multiplication_16)  # -> Geometry, Transform
rad_2 = Radians(Degrees="90")
panel_235 = Panel("Fundamenttiefe aus CSV")
vec_8 = Vector(divide.Tangents)
rectangle_5 = Rectangle(Plane=align_2.Plane, XSize=num_52, YSize=dicke_wand_2, Radius=0)  # -> Rectangle, Length
fastsdiff_7 = FastSolidDifference(
    SubtractFrom=graft(extr_23),
    SubtractWith=data_26,
    Tolerance=0.01,
    computeBBFastSolidDiff=True,
    retainFastSolidDiff=True,
    strictFastSolidDiff=True,
    trueIntFastSolidDiff=False)
fastsdiff_8 = FastSolidDifference(
    SubtractFrom=graft(extr_22),
    SubtractWith=data_26,
    Tolerance=0.01,
    computeBBFastSolidDiff=True,
    retainFastSolidDiff=True,
    strictFastSolidDiff=True,
    trueIntFastSolidDiff=False)
remap_3 = RemapNumbers(Value=dist_2, Source=bnd_6, Target=dom_4)  # -> Mapped, Clipped
boundary_12 = BoundarySurfaces(Edges=flatten([crv_28, offset_14]))
panel_240 = Panel("Dämmdicke CSV")
fastsdiff_9 = FastSolidDifference(
    SubtractFrom=graft(extr_24),
    SubtractWith=data_26,
    Tolerance=0.01,
    computeBBFastSolidDiff=True,
    retainFastSolidDiff=True,
    strictFastSolidDiff=True,
    trueIntFastSolidDiff=False)
num_53 = Number(data_19)
rotate_2 = Rotate(Geometry=vec_8, Angle=rad_2, Plane=PlaneXY(0, 0, 0))  # -> Geometry, Transform
fastsdiff_10 = FastSolidDifference(
    SubtractFrom=graft(extr_25),
    SubtractWith=data_26,
    Tolerance=0.01,
    computeBBFastSolidDiff=True,
    retainFastSolidDiff=True,
    strictFastSolidDiff=True,
    trueIntFastSolidDiff=False)
panel_242 = Panel("Output Data Dichtung")
panel_243 = Panel("Output Data Außenwand")
num_54 = Number(num_11)
num_55 = Number(num_27)
addition_3 = Addition(A=dicke_diffusionsoffene_schicht_2, B=dicke_wand_2)
multiplication_17 = Multiplication(A=remap_3.Mapped, B=item_5)
panel_244 = Panel("Output Data Dämmung")
smaller_6 = SmallerThan(FirstNumber=num_55, SecondNumber="0")  # -> SmallerThan, OrEqualTo
panel_247 = Panel("Höhe Ringbalken Unten")
panel_249 = Panel("Output Data Abdichtung")
panel_251 = Panel("Dicke zweite Dämmschicht")
neg_8 = Negative(Value=num_54)
num_56 = Number(raumhöhe_3)
move_22 = Move(Geometry=rectangle_5.Rectangle, Motion=multiplication_17)  # -> Geometry, Transform
panel_253 = Panel("Höhe Attika")
panel_254 = Panel("Logik Dämmstärke = 0")
num_57 = Number(raumhöhe_3)
addition_4 = Addition(A=dicke_zweite_dämmschicht, B=addition_3)
Z_41 = UnitZ(Factor=neg_8)
subtraction_5 = Subtraction(A=num_56, B=höhe_ringbalken_unten)
num_58 = Number(raumhöhe_3)
subtraction_6 = Subtraction(A=num_57, B=höhe_ringbalken_unten)

# ----
# Summe aus allen Bauteilen nach Wand bilden
num_59 = Number(data_20)
num_60 = Number(data_21)
num_61 = Number(data_22)
num_62 = Number(data_23)

Z_42 = UnitZ(Factor=subtraction_5)
multiplication_18 = Multiplication(A=rotate_2.Geometry, B=addition_4)
Z_43 = UnitZ(Factor=subtraction_6)
dispatch_22 = Dispatch(List=Z_43, DispatchPattern=bool_3)  # -> ListA, ListB
move_23 = Move(Geometry=move_21.Geometry, Motion=multiplication_18)  # -> Geometry, Transform
extr_26 = Extrude(Base=boundary_12, Direction=Z_42)
subtraction_7 = Subtraction(A=num_54, B=ma_2.Result)
extr_27 = Extrude(Base=move_22.Geometry, Direction=dispatch_22.ListA)
ma_3 = MassAddition(Input=[num_59, num_60, num_61, num_62])  # -> Result, PartialResults
panel_269 = Panel("Kurve Abdichtung Außen")
panel_270 = Panel("Kurve Abdichtung")
panel_272 = Panel("Dicke Dämmung")
panel_273 = Panel("Kurve Putz")
cap = CapHoles(Brep=extr_27)
num_63 = Number(data_23)
num_64 = Number(data_22)
fastsdiff_11 = FastSolidDifference(
    SubtractFrom=graft(cap),
    SubtractWith=data_26,
    Tolerance=0.01,
    UseTasks=True,
    computeBBFastSolidDiff=True,
    retainFastSolidDiff=True,
    strictFastSolidDiff=True,
    trueIntFastSolidDiff=False)
# Mass Addition Dicke Bodenaufbau
num_65 = Number(data_20)
# Mass Addition Dicke Bodenaufbau
num_66 = Number(data_23)
# Mass Addition Dicke Bodenaufbau
num_67 = Number(data_21)
# Mass Addition Dicke Bodenaufbau
addition_5 = Addition(A=num_63, B=num_64)
bool_14 = Boolean(bool_6)
neg_9 = Negative(Value=ma_2.Result)
neg_10 = Negative(Value=ma_2.Result)
neg_11 = Negative(Value=ma_2.Result)
Z_44 = UnitZ(Factor=subtraction_7)
neg_12 = Negative(Value=ma_2.Result)
Z_45 = UnitZ(Factor=neg_9)
Z_46 = UnitZ(Factor=neg_10)
Z_47 = UnitZ(Factor=neg_11)
bool_15 = Boolean(bool_6)
Z_48 = UnitZ(Factor=neg_12)
panel_293 = Panel("Logik Holzbau Wechsel")
num_68 = Number(num_27)
panel_294 = Panel("Oben -> Holzbau")
panel_296 = Panel("Output Data Beton")
smaller_7 = SmallerThan(FirstNumber=num_68, SecondNumber="0")  # -> SmallerThan, OrEqualTo
panel_301 = Panel("Logik Bauart Wechsel")
panel_302 = Panel("Oben -> Holz")
panel_305 = Panel("Kurve Massiv")
panel_306 = Panel("Kurve Holz")

# ---- group: Logik Wand Kurven
# Boolean Switch Holz Stein
# Boolean Switch Holz Stein
# Boolean Switch Holz Stein
# Boolean Switch Holz Stein
# Boolean Switch Holz Stein
panel_309 = Panel("Kurve Massiv")
crv_29 = Curve(flip_3.Curve)
panel_315 = Panel("Innenkurve Abdichtung")
panel_316 = Panel("Innenkurve Wand")
panel_317 = Panel("Innenkurve Dämmung")
panel_318 = Panel("Innenkurve Putz")
bool_16 = Boolean(bool_7)
offset_15 = OffsetCurve(Curve=crv_29, Distance=data_24, Corners=1)
bool_17 = Boolean(bool_7)
data_36 = Data(offset_10)
bool_18 = Boolean(bool_7)
data_37 = Data(offset_4)
data_38 = Data(offset_3)
data_39 = Data(offset_11)
data_40 = Data(offset_2)
panel_319 = Panel("Außenkurve Rand")
data_41 = Data(offset_5)
bool_19 = Boolean(bool_7)
data_42 = Data(offset_12)
data_43 = Data(offset_7)
bool_20 = Boolean(bool_7)
data_44 = Data(offset_13)
data_45 = Data(offset_9)
p_n_c_9 = PickNChoose(Pattern=bool_17, Stream0=data_37, Stream1=data_40)
p_n_c_10 = PickNChoose(Pattern=bool_16, Stream0=data_36, Stream1=data_38)
p_n_c_11 = PickNChoose(Pattern=bool_18, Stream0=data_39, Stream1=data_41)
p_n_c_12 = PickNChoose(Pattern=bool_20, Stream0=data_44, Stream1=data_45)
p_n_c_13 = PickNChoose(Pattern=bool_19, Stream0=data_42, Stream1=data_43)
data_46 = Data(p_n_c_9)
data_47 = Data(p_n_c_10)
data_48 = Data(p_n_c_11)
data_49 = Data(p_n_c_13)
data_50 = Data(offset_15)

# ----
crv_30 = Curve(data_50)  # disabled
crv_31 = Curve(data_46)
fpatch_6 = FragmentPatch(Boundary=crv_31)
crv_32 = Curve(crv_31)
move_24 = Move(Geometry=fpatch_6, Motion=neg_3)  # -> Geometry, Transform
srf_2 = Surface(move_24.Geometry)
move_25 = Move(Geometry=srf_2, Motion=neg_4)  # -> Geometry, Transform
srf_3 = Surface(move_25.Geometry)
extr_28 = Extrude(Base=fpatch_6, Direction=neg_3)
extr_29 = Extrude(Base=srf_2, Direction=neg_4)
move_26 = Move(Geometry=srf_3, Motion=neg_5)  # -> Geometry, Transform
srf_4 = Surface(move_26.Geometry)
extr_30 = Extrude(Base=srf_3, Direction=neg_5)
move_27 = Move(Geometry=srf_4, Motion=neg_6)  # -> Geometry, Transform
srf_5 = Surface(move_27.Geometry)
move_28 = Move(Geometry=srf_5, Motion=neg_7)  # -> Geometry, Transform
extr_31 = Extrude(Base=srf_4, Direction=neg_6)
extr_32 = Extrude(Base=srf_5, Direction=neg_7)
offset_16 = OffsetCurve(Curve=crv_32, Distance=num_53, Corners=1)
boundary_13 = BoundarySurfaces(Edges=flatten([crv_32, offset_16]))

panel_320 = Panel("Dampfsperre")
panel_321 = Panel("Bodenplatte")
panel_322 = Panel("Fußbodendämmung")
panel_323 = Panel("Bodenbelag")
panel_324 = Panel("Estrich")
data_51 = Data(extr_28)
data_52 = Data(extr_29)
data_53 = Data(extr_31)
data_54 = Data(extr_32)
data_55 = Data(extr_30)

extr_33 = Extrude(Base=boundary_13, Direction=Z_41)
data_56 = Data(extr_33)
move_29 = Move(Geometry=offset_16, Motion=Z_41)  # -> Geometry, Transform
offset_17 = OffsetCurve(Curve=move_29.Geometry, Distance=ma_3.Result, Corners=1)
crv_33 = Curve(data_47)
crv_34 = Curve(data_48)
crv_35 = Curve(data_49)
crv_36 = Curve(data_49)
offset_18 = OffsetCurve(Curve=crv_33, Distance=num_65, Corners=1)
offset_19 = OffsetCurve(Curve=crv_34, Distance=num_67, Corners=1)
offset_20 = OffsetCurve(Curve=crv_35, Distance=num_66, Corners=1)
boundary_14 = BoundarySurfaces(Edges=flatten([offset_17, move_29.Geometry]))
offset_21 = OffsetCurve(Curve=crv_36, Distance=addition_5, Corners=1)
boundary_15 = BoundarySurfaces(Edges=flatten([crv_33, offset_18]))
boundary_16 = BoundarySurfaces(Edges=flatten([crv_34, offset_19]))
boundary_17 = BoundarySurfaces(Edges=flatten([crv_35, offset_20]))
boundary_18 = BoundarySurfaces(Edges=flatten([crv_36, offset_21]))
extr_34 = Extrude(Base=boundary_14, Direction=Z_44)
extr_35 = Extrude(Base=boundary_15, Direction=Z_45)
extr_36 = Extrude(Base=boundary_16, Direction=Z_46)
extr_37 = Extrude(Base=boundary_17, Direction=Z_47)
extr_38 = Extrude(Base=boundary_18, Direction=Z_48)
dispatch_23 = Dispatch(List=extr_37, DispatchPattern=bool_7)  # -> ListA, ListB
dispatch_24 = Dispatch(List=extr_38, DispatchPattern=bool_7)  # -> ListA, ListB
data_57 = Data(extr_35)
data_58 = Data([extr_34, data_56])
data_59 = Data(extr_36)
dispatch_25 = Dispatch(List=data_59, DispatchPattern=smaller_7.OrEqualTo)  # -> ListA, ListB
data_60 = Data([dispatch_24.ListB, dispatch_23.ListA])
data_61 = Data(dispatch_25.ListB)
num_69 = Number(num_3)
dicke_betondecke = Slider(0.2, range=0.07..0.25)
dicke_dampfsperre_2 = Slider(0.011, range=0.011..0.02)
dicke_dämmung = Slider(0.1, range=0..0.25)
überstand_attika = Slider(0.3, range=0.3..0.5)
ma_4 = MassAddition(Input=[dicke_betondecke, data_20, überstand_attika, dicke_dampfsperre_2, dicke_dämmung])  # -> Result, PartialResults
höhe_attika = Number(ma_4.Result)
num_70 = Number(höhe_attika)
ma_5 = MassAddition(Input=[num_58, num_70])  # -> Result, PartialResults
dispatch_26 = Dispatch(List=ma_5.Result, DispatchPattern=bool_3)  # -> ListA, ListB
Z_49 = UnitZ(Factor=dispatch_26.ListA)
extr_39 = Extrude(Base=move_23.Geometry, Direction=Z_49)
cap_2 = CapHoles(Brep=extr_39)
fastsdiff_12 = FastSolidDifference(
    SubtractFrom=graft(cap_2),
    SubtractWith=data_26,
    Tolerance=0.01,
    computeBBFastSolidDiff=True,
    retainFastSolidDiff=True,
    strictFastSolidDiff=True,
    trueIntFastSolidDiff=False)
data_62 = Data(fastsdiff_12)
panel_326 = Panel("Dicke Aufbau Attika")

# ---- group: Holz Attika
# Nur Aktiv wenn Holz Aktiv
# Raumhöhe - Höhe Ringbalken Unten
panel_327 = Panel("Höhe Attika")
num_71 = Number(höhe_attika)
panel_328 = Panel("Höhe Deckenplatte")
dicke_abschlussbrett = Slider(0.03, range=0..0.1)
subtraction_8 = Subtraction(A=num_71, B=dicke_betondecke)
panel_330 = Panel("Dicke Abschlussbrett")
panel_333 = Panel("Kuve Dämmung Oben")
addition_6 = Addition(A=num_69, B=dicke_betondecke)
rectangle_6 = Rectangle(Plane=PlaneXY(0, 0, 0), XSize=dicke_wand_2, YSize=dicke_abschlussbrett, Radius=0)  # -> Rectangle, Length
subtraction_9 = Subtraction(A=subtraction_8, B=dicke_abschlussbrett)
crv_37 = Curve(move_19.Geometry)
dispatch_27 = Dispatch(List=data_46, DispatchPattern=bool_3)  # -> ListA, ListB
Z_50 = UnitZ(Factor=addition_6)
dispatch_28 = Dispatch(List=move_22.Geometry, DispatchPattern=bool_7)  # -> ListA, ListB
num_72 = Number(data_19)
dispatch_29 = Dispatch(List=crv_37, DispatchPattern=bool_3)  # -> ListA, ListB
move_30 = Move(Geometry=dispatch_27.ListA, Motion=Z_50)  # -> Geometry, Transform
dispatch_30 = Dispatch(List=dispatch_28.ListA, DispatchPattern=bool_3)  # -> ListA, ListB
num_73 = Number(höhe_attika)
num_74 = Number()
Z_51 = UnitZ(Factor=num_73)
rectangle_7 = Rectangle(Plane=PlaneXY(0, 0, 0), XSize=subtraction_9, YSize=num_72, Radius=0)  # -> Rectangle, Length
Z_52 = UnitZ(Factor=num_74)
move_31 = Move(Geometry=dispatch_29.ListA, Motion=Z_51)  # -> Geometry, Transform
subtraction_10 = Subtraction(A=höhe_attika, B=dicke_abschlussbrett)
cluster_2 = Cluster_2(grundriss=move_30.Geometry, A=Slider(180, range=-180..180), wand=rectangle_7.Rectangle)
move_32 = Move(Geometry=dispatch_30.ListA, Motion=Z_52)  # -> Geometry, Transform
panel_346 = Panel("Dicke Ringbalken / Decke")
cluster_3 = Cluster_2(grundriss=move_31.Geometry, A=Slider(0, range=-180..180), wand=rectangle_6.Rectangle)
num_75 = Number(dicke_betondecke)
data_63 = Data(cluster_3)
subtraction_11 = Subtraction(A=subtraction_10, B=num_75)
Z_53 = UnitZ(Factor=num_75)
data_64 = Data(cluster_2)
move_33 = Move(Geometry=move_32.Geometry, Motion=Z_53)  # -> Geometry, Transform
Z_54 = UnitZ(Factor=subtraction_11)
extr_40 = Extrude(Base=move_33.Geometry, Direction=Z_54)
cap_3 = CapHoles(Brep=data_63)
cap_4 = CapHoles(Brep=extr_40)
fastsdiff_13 = FastSolidDifference(
    SubtractFrom=data_64,
    SubtractWith=cap_4,
    Tolerance=0.01,
    computeBBFastSolidDiff=True,
    retainFastSolidDiff=True,
    strictFastSolidDiff=True,
    trueIntFastSolidDiff=False)
data_65 = Data([cap_4, cap_3])
data_66 = Data(fastsdiff_13)

# ----
dispatch_31 = Dispatch(List=data_46, DispatchPattern=bool_3)  # -> ListA, ListB
Z_55 = UnitZ(Factor=num_69)
move_34 = Move(Geometry=dispatch_31.ListA, Motion=Z_55)  # -> Geometry, Transform
offset_22 = OffsetCurve(Curve=move_34.Geometry, Distance=data_19, Corners=1)
boundary_19 = BoundarySurfaces(Edges=flatten([offset_22, move_34.Geometry]))
Z_56 = UnitZ(Factor=höhe_attika)
extr_41 = Extrude(Base=boundary_19, Direction=Z_56)
dispatch_32 = Dispatch(List=extr_41, DispatchPattern=bool_7)  # -> ListA, ListB
data_67 = Data(dispatch_32.ListB)

# ----
# Hier noch korregieren Holz
# Randkurve Wand für Sweep Innere Abdichtung
# Brep Mauer für Abdichtung Oberseite Mauer
panel_356 = Panel("Raumhöhe")
dispatch_33 = Dispatch(List=data_47, DispatchPattern=bool_3)  # -> ListA, ListB
Z_57 = UnitZ(Factor=num_69)
num_76 = Number(data_20)
move_35 = Move(Geometry=dispatch_33.ListA, Motion=Z_57)  # -> Geometry, Transform
num_77 = Number(höhe_attika)
offset_23 = OffsetCurve(Curve=move_35.Geometry, Distance=num_76, Corners=1)
addition_7 = Addition(A=num_77, B=num_76)
boundary_20 = BoundarySurfaces(Edges=flatten([move_35.Geometry, offset_23]))
Z_58 = UnitZ(Factor=addition_7)
extr_42 = Extrude(Base=boundary_20, Direction=Z_58)
Z_59 = UnitZ(Factor=höhe_attika)
brep_5 = Brep(boundary_19)
move_36 = Move(Geometry=brep_5, Motion=Z_59)  # -> Geometry, Transform
Z_60 = UnitZ(Factor=num_76)
extr_43 = Extrude(Base=move_36.Geometry, Direction=Z_60)
addition_8 = Addition(A=höhe_attika, B=num_69)
num_78 = Number(data_20)
crv_38 = Curve(data_46)
addition_9 = Addition(A=addition_8, B=num_78)
dispatch_34 = Dispatch(List=crv_38, DispatchPattern=bool_3)  # -> ListA, ListB
Z_61 = UnitZ(Factor=addition_9)
panel_367 = Panel("Dicke Deckenplatte")
move_37 = Move(Geometry=dispatch_34.ListA, Motion=Z_61)  # -> Geometry, Transform
num_79 = Number(höhe_attika)
neg_13 = Negative(Value=num_78)
subtraction_12 = Subtraction(A=num_79, B=dicke_betondecke)
offset_24 = OffsetCurve(Curve=move_37.Geometry, Distance=neg_13, Corners=1)
neg_14 = Negative(Value=subtraction_12)
boundary_21 = BoundarySurfaces(Edges=flatten([offset_24, move_37.Geometry]))
Z_62 = UnitZ(Factor=neg_14)
extr_44 = Extrude(Base=boundary_21, Direction=Z_62)
data_68 = Data(extr_44)
data_69 = Data([data_68, extr_42, extr_43])

# ----
# Randkurve Wand für Sweep Innere Dämmung
# Kurve Abdichtung Dach Oben Außen
panel_370 = Panel("Raumhöhe")
dispatch_35 = Dispatch(List=data_48, DispatchPattern=bool_3)  # -> ListA, ListB
Z_63 = UnitZ(Factor=num_69)
panel_373 = Panel("Dicke Aüßere Dämmung")
move_38 = Move(Geometry=dispatch_35.ListA, Motion=Z_63)  # -> Geometry, Transform
panel_374 = Panel("Dicke Dach Dämmung")
num_80 = Number(data_21)
num_81 = Number(höhe_attika)
num_82 = Number(dicke_dämmung)
offset_25 = OffsetCurve(Curve=move_38.Geometry, Distance=num_80, Corners=1)
addition_10 = Addition(A=num_81, B=num_82)
boundary_22 = BoundarySurfaces(Edges=flatten([move_38.Geometry, offset_25]))
Z_64 = UnitZ(Factor=addition_10)
extr_45 = Extrude(Base=boundary_22, Direction=Z_64)
num_83 = Number(data_21)
smaller_8 = SmallerThan(FirstNumber=num_83, SecondNumber="0")  # -> SmallerThan, OrEqualTo
data_70 = Data(extr_45)
dispatch_36 = Dispatch(List=data_70, DispatchPattern=smaller_8.OrEqualTo)  # -> ListA, ListB
data_71 = Data(dispatch_36.ListB)
num_84 = Number(data_20)
multiplication_19 = Multiplication(A=num_84, B="2")
crv_39 = Curve(offset_24)
num_85 = Number(data_19)
addition_11 = Addition(A=num_85, B=multiplication_19)
offset_26 = OffsetCurve(Curve=crv_39, Distance=addition_11, Corners=1)
num_86 = Number(dicke_dämmung)
num_87 = Number(data_20)
boundary_23 = BoundarySurfaces(Edges=flatten([crv_39, offset_26]))
subtraction_13 = Subtraction(A=num_86, B=num_87)
Z_65 = UnitZ(Factor=subtraction_13)
extr_46 = Extrude(Base=boundary_23, Direction=Z_65)
num_88 = Number(dicke_dämmung)
addition_12 = Addition(A=höhe_attika, B=num_69)
num_89 = Number(data_20)
crv_40 = Curve(data_46)
addition_13 = Addition(A=addition_12, B=num_88)
dispatch_37 = Dispatch(List=crv_40, DispatchPattern=bool_3)  # -> ListA, ListB
Z_66 = UnitZ(Factor=addition_13)
move_39 = Move(Geometry=dispatch_37.ListA, Motion=Z_66)  # -> Geometry, Transform
neg_15 = Negative(Value=num_89)
offset_27 = OffsetCurve(Curve=move_39.Geometry, Distance=neg_15, Corners=1)
neg_16 = Negative(Value=num_88)
num_90 = Number(höhe_attika)
offset_28 = OffsetCurve(Curve=offset_27, Distance=neg_16, Corners=1)
subtraction_14 = Subtraction(A=num_90, B=dicke_betondecke)
neg_17 = Negative(Value=subtraction_14)
boundary_24 = BoundarySurfaces(Edges=flatten([offset_28, offset_27]))
Z_67 = UnitZ(Factor=neg_17)
extr_47 = Extrude(Base=boundary_24, Direction=Z_67)
data_72 = Data(extr_47)
panel_390 = Panel("Abzug Abdichtung")
fastsdiff_14 = FastSolidDifference(
    SubtractFrom=data_72,
    SubtractWith=data_68,
    Tolerance=0.01,
    computeBBFastSolidDiff=True,
    retainFastSolidDiff=True,
    strictFastSolidDiff=True,
    trueIntFastSolidDiff=False)
data_73 = Data([fastsdiff_14, extr_46, data_71])

dispatch_38 = Dispatch(List=data_46, DispatchPattern=bool_3)  # -> ListA, ListB
Z_68 = UnitZ(Factor=num_69)
move_40 = Move(Geometry=dispatch_38.ListA, Motion=Z_68)  # -> Geometry, Transform
panel_395 = Panel("Dicke Betondecke")
Z_69 = UnitZ(Factor=dicke_betondecke)
fpatch_7 = FragmentPatch(Boundary=move_40.Geometry)
number_slider_5 = Slider(2.86, range=1..5)
extr_48 = Extrude(Base=fpatch_7, Direction=Z_69)
move_41 = Move(Geometry=move_40.Geometry, Motion=Z_69)  # -> Geometry, Transform
bbox = BoundingBox(Plane=PlaneXY(0, 0, 0))  # -> Box, Box_2
relay = Relay()
debox = DeconstructBox(Box=bbox.Box)  # -> Plane, X, Y, Z
Z_70 = UnitZ(Factor=debox.Z)
rev_2 = Reverse(Vector=Z_70)
extr_49 = Extrude(Base=relay, Direction=rev_2)
data_74 = Data(extr_48)
panel_396 = Panel("Betondecke")
brep_6 = Brep(relay)
fastsdiff_15 = FastSolidDifference(
    SubtractFrom=extr_49,
    SubtractWith=extr_48,
    Tolerance=0.01,
    computeBBFastSolidDiff=True,
    retainFastSolidDiff=True,
    strictFastSolidDiff=True,
    trueIntFastSolidDiff=False)
panel_397 = Panel("Dicke Dampfsperre")
data_75 = Data(fastsdiff_15)
panel_398 = Panel("Gefälleestrich")
Z_71 = UnitZ(Factor=dicke_dampfsperre_2)
move_42 = Move(Geometry=brep_6, Motion=Z_71)  # -> Geometry, Transform
extr_50 = Extrude(Base=brep_6, Direction=Z_71)
Z_72 = UnitZ(Factor=dicke_dämmung)
data_76 = Data(extr_50)
extr_51 = Extrude(Base=move_42.Geometry, Direction=Z_72)
move_43 = Move(Geometry=move_42.Geometry, Motion=Z_72)  # -> Geometry, Transform
fastsdiff_16 = FastSolidDifference(
    SubtractFrom=extr_51,
    SubtractWith=data_68,
    Tolerance=0.01,
    computeBBFastSolidDiff=True,
    retainFastSolidDiff=True,
    strictFastSolidDiff=True,
    trueIntFastSolidDiff=False)
Z_73 = UnitZ(Factor=data_20)
panel_403 = Panel("""Abzug Abdichtung
+ Dämmung""")
extr_52 = Extrude(Base=move_43.Geometry, Direction=Z_73)
data_77 = Data(fastsdiff_16)
fastsdiff_17 = FastSolidDifference(
    SubtractFrom=extr_52,
    SubtractWith=[data_68, data_72],
    Tolerance=0.01,
    computeBBFastSolidDiff=True,
    retainFastSolidDiff=True,
    strictFastSolidDiff=True,
    trueIntFastSolidDiff=False)
data_78 = Data(fastsdiff_17)

# ----
# Kurve Dämmung Dach Oben Außen
panel_406 = Panel("Raumhöhe")
dispatch_39 = Dispatch(List=data_49, DispatchPattern=bool_3)  # -> ListA, ListB
Z_74 = UnitZ(Factor=num_69)
move_44 = Move(Geometry=dispatch_39.ListA, Motion=Z_74)  # -> Geometry, Transform
num_91 = Number(dicke_dämmung)
num_92 = Number(höhe_attika)
num_93 = Number(data_23)
ma_6 = MassAddition(Input=[num_92, num_91])  # -> Result, PartialResults
offset_29 = OffsetCurve(Curve=move_44.Geometry, Distance=num_93, Corners=1)
boundary_25 = BoundarySurfaces(Edges=flatten([offset_29, move_44.Geometry]))
Z_75 = UnitZ(Factor=ma_6.Result)
extr_53 = Extrude(Base=boundary_25, Direction=Z_75)
data_79 = Data(extr_53)
num_94 = Number(höhe_attika)
num_95 = Number(dicke_dämmung)
addition_14 = Addition(A=num_94, B=num_95)
Z_76 = UnitZ(Factor=addition_14)
move_45 = Move(Geometry=offset_29, Motion=Z_76)  # -> Geometry, Transform
crv_41 = Curve(offset_28)
boundary_26 = BoundarySurfaces(Edges=flatten([move_45.Geometry, crv_41]))
num_96 = Number(data_20)
Z_77 = UnitZ(Factor=num_96)
extr_54 = Extrude(Base=boundary_26, Direction=Z_77)
move_46 = Move(Geometry=crv_41, Motion=Z_77)  # -> Geometry, Transform
num_97 = Number(höhe_attika)
num_98 = Number(data_20)
subtraction_15 = Subtraction(A=num_97, B=dicke_betondecke)
neg_18 = Negative(Value=num_98)
offset_30 = OffsetCurve(Curve=move_46.Geometry, Distance=neg_18, Corners=1)
addition_15 = Addition(A=subtraction_15, B=num_98)
neg_19 = Negative(Value=addition_15)
boundary_27 = BoundarySurfaces(Edges=flatten([offset_30, move_46.Geometry]))
Z_78 = UnitZ(Factor=neg_19)
extr_55 = Extrude(Base=boundary_27, Direction=Z_78)
data_80 = Data([extr_54, extr_55])

num_99 = Number(data_20)
num_100 = Number(data_20)
num_101 = Number(data_21)
num_102 = Number(dicke_dämmung)
num_103 = Number(data_19)
num_104 = Number(dicke_dampfsperre_2)
num_105 = Number(data_22)
num_106 = Number(data_23)
panel_420 = Panel("Abdichtung 2 mal")
num_107 = Number(num_99)
num_108 = Number(num_99)
panel_421 = Panel("Dicke Dichtung")
panel_425 = Panel("Dachneigung Flachdach")
dispatch_40 = Dispatch(List=data_50, DispatchPattern=bool_3)  # -> ListA, ListB
addition_16 = Addition(A=höhe_attika, B=num_69)
num_109 = Number(data_20)
num_110 = Number(dicke_dämmung)
ma_7 = MassAddition(Input=[num_99, num_100, num_102, num_101, num_103, num_104, num_108, num_105, num_107, num_106])  # -> Result, PartialResults
rad_3 = Radians(Degrees=number_slider_5)
panel_428 = Panel("""Dach Randkurve

Logik Dachauswahl""")
addition_17 = Addition(A=addition_16, B=num_109)
# Logik Dicke zweite Dämmschicht Holz
panel_429 = Panel("Dämmstärke aus CSV")
tan = Tangent(Value=rad_3)
addition_18 = Addition(A=num_110, B=addition_17)
list = ValueList({"Round : Constant slope(sand)": 0, "Butt  : Angular(roof)": 1, "Square : Simple": 2}, selected="Round : Constant slope(sand)")
panel_431 = Panel("Oben -> Satteldach")
multiplication_20 = Multiplication(A=tan, B=ma_7.Result)
neg_20 = Negative(Value=ma_7.Result)
addition_19 = Addition(A=addition_18)
Z_79 = UnitZ(Factor=multiplication_20)
Z_80 = UnitZ(Factor=addition_19)
regiontoroof = CurveRegionToRoof(Curves=move_41.Geometry, AngleOfRoof=degrees(number_slider_5), RoofType=list, Tolerance=0.001)  # -> Roof, MedialAxis
num_111 = Number(höhe_attika)
move_47 = Move(Geometry=dispatch_40.ListA, Motion=Z_80)  # -> Geometry, Transform
division_2 = Division(A=num_111, B="4")
offset_31 = OffsetCurve(Curve=move_47.Geometry, Distance=neg_20, Corners=1)
neg_21 = Negative(Value=division_2)
dicke_unterspannbahn = Slider(0.005, range=0.001..0.1)
dicke_vorverdeckung = Slider(0.005, range=0.001..0.1)
dicke_lattung = Slider(0.03, range=0.01..0.1)
panel_434 = Panel("Roof Brep Joined")
panel_435 = Panel("Lattung dach höhe")
panel_436 = Panel("Konterlattung dach höhe")
breite_balken = Slider(0.05, range=0..1)
höhe_balken = Slider(0.2, range=0..1)
num_112 = Number(höhe_balken)
subtraction_16 = Subtraction(A=num_2, B=num_112)
smaller_9 = SmallerThan(FirstNumber=subtraction_16, SecondNumber="0")  # -> SmallerThan, OrEqualTo
p_n_c_14 = PickNChoose(Pattern=smaller_9.OrEqualTo, Stream0=subtraction_16, Stream1="0")
Z_81 = UnitZ(Factor=neg_21)
Z_82 = UnitZ(Factor=1)
move_48 = Move(Geometry=offset_31, Motion=Z_79)  # -> Geometry, Transform
panel_438 = Panel("Dachüberstand")
md_slider_5 = MDSlider(SliderMode=0, slider_value=Point(0.5, 0.5, 0.5), x_domain=Domain(0, 1), y_domain=Domain(0, 1), z_domain=Domain(0, 1))
move_49 = Move(Geometry=move_47.Geometry, Motion=Z_81)  # -> Geometry, Transform
num_113 = Number(höhe_attika)
num_114 = Number(p_n_c_14)
num_115 = Number(höhe_balken)
num_116 = Number(dicke_unterspannbahn)
dicke_vorverdeckung_2 = Number(dicke_vorverdeckung)
num_117 = Number(breite_balken)
num_118 = Number(dicke_lattung)
loft = Loft(
    Curves=flatten([move_48.Geometry, move_47.Geometry]),
    Options={Adjust=False, Closed=False, LoftEnds=0, LoftSimp=0, LoftType=0, Rebuild=10, Refit=0.01})
panel_440 = Panel("Outside Curves Roof")
division_3 = Division(A=num_113, B="4")
loft_2 = Loft(
    Curves=flatten([move_47.Geometry, move_49.Geometry]),
    Options={Adjust=False, Closed=False, LoftEnds=0, LoftSimp=0, LoftType=0, Rebuild=10, Refit=0.01})
neg_22 = Negative(Value=division_3)
Z_83 = UnitZ(Factor=1)
panel_441 = Panel("Breps Balken")
md_slider_6 = MDSlider(SliderMode=0, slider_value=Point(0.5, 0.5, 0.5), x_domain=Domain(0, 1), y_domain=Domain(0, 1), z_domain=Domain(0, 1))
panel_443 = Panel("Breps Split Roof")
Z_84 = UnitZ(Factor=Slider(0.06, range=0..0.1))
Z_85 = UnitZ(Factor=neg_22)
# Breps Nach Oben Roof
panel_444 = Panel("Höhe Balken")
xy_3 = XYPlane(Origin=Point(0, 0, 0))
Y_2 = UnitY(Factor=1)
Z_86 = UnitZ(Factor=1)
num_119 = Number(num_115)
move_50 = Move(Geometry=move_48.Geometry, Motion=Z_85)  # -> Geometry, Transform
md_slider_7 = MDSlider(SliderMode=0, slider_value=Point(0.5, 0.5, 0.5), x_domain=Domain(0, 1), y_domain=Domain(0, 1), z_domain=Domain(0, 1))
md_slider_8 = MDSlider(SliderMode=0, slider_value=Point(0.5, 0.5, 0.5), x_domain=Domain(0, 1), y_domain=Domain(0, 1), z_domain=Domain(0, 1))
Z_87 = UnitZ(Factor="-1")
Z_88 = UnitZ(Factor=num_119)
loft_3 = Loft(
    Curves=flatten([move_50.Geometry, move_48.Geometry]),
    Options={Adjust=False, Closed=False, LoftEnds=0, LoftSimp=0, LoftType=0, Rebuild=10, Refit=0.01})
Z_89 = UnitZ(Factor="5")
xy_4 = XYPlane(Origin=Point(0, 0, 0))
Y_3 = UnitY(Factor=1)
xy_5 = XYPlane(Origin=Point(0, 0, 0))
Y_4 = UnitY(Factor=1)
join_7 = BrepJoin(Breps=[loft_2, loft, loft_3])  # -> Breps, Closed
xy_6 = XYPlane(Origin=Point(0, 0, 0))
Y_5 = UnitY(Factor=1)
abdeckung_dach_dicke = Slider(0.015, range=0.01..0.02)
abstand_konterlattung = Number(Slider(0.2, range=0..1))
neg_23 = Negative(Value=Slider(0.005, range=0..0.01))
neg_24 = Negative(Value="1")
xy_7 = XYPlane(Origin=Point(0, 0, 0))
offsrf_2 = OffsetSurface(Surface=join_7.Breps, Distance=abdeckung_dach_dicke, BothSides=0, CreateSolid=True)
panel_448 = Panel("Output Data Ziegel")
panel_449 = Panel("Dicke Lattung")
panel_450 = Panel("Brep Dachbalken")
dicke_unterspannbahn_2 = Number(num_116)
num_120 = Number(num_118)
Z_90 = UnitZ(Factor=dicke_unterspannbahn_2)
neg_25 = Negative(Value=num_120)
data_81 = Data(offsrf_2)
data_82 = Data([data_81, data_28, data_34])
mcol_2 = MeshColours(Mesh=data_82, Colours=colour_swatch_2)
mesh_2 = Mesh(mcol_2)
custom_preview_2 = CustomPreview(Geometry=data_82, Material=create_material_7)
ma_8 = MassAddition(Input=[num_115, num_116, num_114, dicke_vorverdeckung_2])  # -> Result, PartialResults
Z_91 = UnitZ(Factor=ma_8.Result)
panel_452 = Panel("Dicke Dach Rand")
list_2 = ValueList({"Round : Constant slope (sand)": 0, "Butt  : Angular (roof)": 1, "Square : Simple": 2, "Ellipse : Constant slope (sand)": 3}, selected="Butt  : Angular (roof)")
num_121 = Number(num_118)
ma_9 = MassAddition(Input=[num_115, num_116, num_114, dicke_vorverdeckung_2, num_121])  # -> Result, PartialResults
Z_92 = UnitZ(Factor=ma_9.Result)
num_122 = Number(num_5)
dicke_unterspannbahn_3 = Number(num_114)
md_slider_9 = MDSlider(SliderMode=0, slider_value=Point(0.5, 0.5, 0.5), x_domain=Domain(0, 1), y_domain=Domain(0, 1), z_domain=Domain(0, 1))
Z_93 = UnitZ(Factor=num_121)
Z_94 = UnitZ(Factor=dicke_unterspannbahn_3)
num_123 = Number(num_118)
xy_8 = XYPlane(Origin=Point(0, 0, 0))
dicke_unterspannbahn_4 = Number(dicke_vorverdeckung_2)
Z_95 = UnitZ(Factor=dicke_unterspannbahn_4)
breite_balken_2 = Number(num_117)
panel_458 = Panel("Breite Balken")
xy_9 = XYPlane(Origin=Point(0, 0, 0))
neg_26 = Negative(Value=breite_balken_2)
breite_balken_3 = Number(num_115)
panel_461 = Panel("Höhe Balken")
Z_96 = UnitZ(Factor=breite_balken_3)

# ---- group: Recompute
number_slider_6 = Slider(15, range=0..100)  # disabled
rectangle_8 = Rectangle(Plane=PlaneXY(0, 0, 0), XSize=number_slider_6, YSize=number_slider_6, Radius=0)  # -> Rectangle, Length; disabled
move_51 = Move(Geometry=rectangle_8.Rectangle, Motion=Z_17)  # -> Geometry, Transform; disabled
srf_6 = Surface(move_51.Geometry)  # disabled
number_slider_7 = Slider(1, range=0..1)  # disabled

# ---- group: Dachteil
panel_463 = Panel("Surface Wandbauteil")
panel_464 = Panel("Vektor Raumhöhe")
srf_7 = Surface(boundary_5)
vec_9 = Vector(Z_24)
move_52 = Move(Geometry=join_4, Motion=vec_9)  # -> Geometry, Transform
Z_97 = UnitZ(Factor="15")
extr_56 = Extrude(Base=move_52.Geometry, Direction=Z_97)

srf_8 = Surface(boundary_5)
vec_10 = Vector(Z_24)
move_53 = Move(Geometry=srf_8, Motion=vec_10)  # -> Geometry, Transform
Z_98 = UnitZ(Factor="15")
extr_57 = Extrude(Base=move_53.Geometry, Direction=Z_98)

srf_9 = Surface(boundary_9)
vec_11 = Vector(Z_25)
move_54 = Move(Geometry=srf_9, Motion=vec_11)  # -> Geometry, Transform
Z_99 = UnitZ(Factor="15")
extr_58 = Extrude(Base=move_54.Geometry, Direction=Z_99)
# Grundriss nach tragender Wand
panel_471 = Panel("Dach Brep")

srf_10 = Surface(boundary_4)
vec_12 = Vector(Z_20)
move_55 = Move(Geometry=srf_10, Motion=vec_12)  # -> Geometry, Transform
Z_100 = UnitZ(Factor="15")
extr_59 = Extrude(Base=move_55.Geometry, Direction=Z_100)

srf_11 = Surface(boundary_10)
vec_13 = Vector(Z_26)
move_56 = Move(Geometry=srf_11, Motion=vec_13)  # -> Geometry, Transform
Z_101 = UnitZ(Factor="15")
extr_60 = Extrude(Base=move_56.Geometry, Direction=Z_101)

srf_12 = Surface(boundary_2)
vec_14 = Vector(Z_14)
move_57 = Move(Geometry=srf_12, Motion=vec_14)  # -> Geometry, Transform
Z_102 = UnitZ(Factor="15")
extr_61 = Extrude(Base=move_57.Geometry, Direction=Z_102)

Z_103 = UnitZ(Factor="15")

# ---- group: Beton bei Satteldach
panel_484 = Panel("Ost West Kurven")
num_124 = Number(raumhöhe_4)
Z_104 = UnitZ(Factor=num_124)
data_83 = Data([data_2, data_3])
num_125 = Number(data_18)
move_58 = Move(Geometry=data_83, Motion=Z_104)  # -> Geometry, Transform
neg_27 = Negative(Value=num_125)
num_126 = Number(data_19)
offset_32 = OffsetCurve(Curve=move_58.Geometry, Distance=neg_27, Corners=1)
neg_28 = Negative(Value=num_126)
offset_33 = OffsetCurve(Curve=offset_32, Distance=neg_28, Corners=1)
rulesrf = RuledSurface(CurveA=offset_32, CurveB=offset_33)
Z_105 = UnitZ(Factor=Slider(10, range=0..10))
extr_62 = Extrude(Base=rulesrf, Direction=Z_105)

# ---- group: Satteldach Randbalken
panel_489 = Panel("Nord Süd Kurven")
num_127 = Number(data_18)
data_84 = Data([data_2, data_3])
neg_29 = Negative(Value=num_127)
num_128 = Number(data_19)
offset_34 = OffsetCurve(Curve=data_84, Distance=neg_29, Corners=1)
neg_30 = Negative(Value=num_128)
offset_35 = OffsetCurve(Curve=offset_34, Distance=neg_30, Corners=1)
rulesrf_2 = RuledSurface(CurveA=offset_34, CurveB=offset_35)
Z_106 = UnitZ(Factor=Slider(10, range=0..10))
extr_63 = Extrude(Base=rulesrf_2, Direction=Z_106)

# ---- group: Dachlatten
panel_492 = Panel("Dach Kurve Sortiert")
rad_4 = Radians(Degrees="270")
xy_10 = XYPlane(Origin=Point(0, 0, 0))
höhe_dachpfetten = Slider(0.2, range=0.1..1)
Z_107 = UnitZ(Factor=höhe_dachpfetten)
neg_31 = Negative(Value=Z_107)
panel_496 = Panel("Sdiff Dachbalken")
panel_497 = Panel("Abzug Ringbalken Dachbalken")

# ---- group: Dachaufbau
dicke_aufsparrendämmung = Slider(0.1, range=0..0.1)
dicke_vorverdeckung_3 = Slider(0.005, range=0.001..0.1)
panel_499 = Panel("Dach Brep Joined")
dicke_unterspannbahn_5 = Slider(0.005, range=0.001..0.1)
Z_108 = UnitZ(Factor=dicke_unterspannbahn_5)
Z_109 = UnitZ(Factor=dicke_aufsparrendämmung)
Z_110 = UnitZ(Factor=dicke_vorverdeckung_3)

# ---- group: Dachbalken
breite_dachträger = Slider(0.15, range=0..1)
panel_503 = Panel("Dachpfetten Höhe")
neg_32 = Negative(Value=höhe_dachpfetten)
Z_111 = UnitZ(Factor=neg_32)
rad_5 = Radians(Degrees="90")
xy_11 = XYPlane(Origin=Point(0, 0, 0))
Z_112 = UnitZ(Factor=1)
division_4 = Division(A=breite_dachträger, B="2")
Z_113 = UnitZ(Factor="-2")
Z_114 = UnitZ(Factor=1)

# ----
num_129 = Number(breite_dachträger)
min = Minimum(A=num_129, B=num_122)
neg_33 = Negative(Value=min)

# ---- group: Zwischensparrendämmung und Cutoff für Dämmung
panel_507 = Panel("Höhe Dachpfetten")
Z_115 = UnitZ(Factor=höhe_dachpfetten)
neg_34 = Negative(Value=Z_115)
panel_509 = Panel("""Extrusion Pfette &
Dachbalken""")

# ---- group: Dach Grundform
data_85 = Data(data_50)
dispatch_41 = Dispatch(List=data_85, DispatchPattern=bool_3)  # -> ListA, ListB
crv_42 = Curve(flatten(dispatch_41.ListB))
offset_36 = OffsetCurve(Curve=crv_42, Distance=num_5, Corners=1)
Z_116 = UnitZ(Factor=num_3)
move_59 = Move(Geometry=offset_36, Motion=Z_116)  # -> Geometry, Transform
panel_513 = Panel("Dachneigung aus CSV")
list_3 = ValueList({"Round : Constant slope(sand)": 0, "Butt  : Angular(roof)": 1, "Square : Simple": 2}, selected="Butt  : Angular(roof)")
num_130 = Number(num_10)
panel_514 = Panel("Sortieren Reihenfolge Surfaces")

# ----
dispatch_42 = Dispatch(List=move_59.Geometry, DispatchPattern=bool_6)  # -> ListA, ListB
simplify_3 = SimplifyCurve(Curve=dispatch_42.ListA, Tolerance="0.01", AngleTolerance="0.1")  # -> Curve, Simplified
explode_2 = Explode(Curve=simplify_3.Curve, Recursive=True)  # -> Segments, Vertices
extr_64 = Extrude(Base=explode_2.Segments, Direction=Z_82)
evalsrf_5 = EvaluateSurface(Surface=reparameterize(extr_64), Point=md_slider_5)  # -> Point, Normal, UDirection, VDirection, Frame
angle_2 = Angle(VectorA=evalsrf_5.Normal, VectorB=Y_2, Plane=xy_3)  # -> Angle, Reflex
dispatch_43 = Dispatch(List=move_59.Geometry, DispatchPattern=bool_6)  # -> ListA, ListB
deg_2 = Degrees(Radians=angle_2.Angle)

# ---- group: Dach Grundform (continued)
flip_4 = FlipCurve(Curve=dispatch_43.ListB)  # -> Curve, Flag
regiontoroof_2 = CurveRegionToRoof(Curves=flip_4.Curve, AngleOfRoof=degrees(num_130), RoofType=list_3, Tolerance=0.001)  # -> Roof, MedialAxis
edges_10 = BrepEdges(Brep=regiontoroof_2.Roof)  # -> Naked, Interior, NonManifold
debrep_4 = DeconstructBrep(Brep=regiontoroof_2.Roof)  # -> Faces, Edges, Vertices
brep_7 = Brep(regiontoroof_2.Roof)
midpt_8 = CurveMiddle(Curve=edges_10.Naked)
srf_cp = SurfaceClosestPoint(Point=graft(midpt_8), Surface=debrep_4.Faces)  # -> Point, UVPoint, Distance
bnd_7 = Bounds(Numbers=srf_cp.Distance)
dedomain_5 = DeconstructDomain(Domain=bnd_7)  # -> Start, End
equals_6 = Equality(FirstNumber=srf_cp.Distance, SecondNumber=dedomain_5.Start)  # -> Equality, Inequality
invbool_2 = InvertBoolean(Boolean=equals_6.Equality)  # -> Inverted, Number
dispatch_44 = Dispatch(List=debrep_4.Faces, DispatchPattern=invbool_2.Inverted)  # -> ListA, flatten(ListB)
srf_13 = Surface(dispatch_44.ListB)
crv_43 = Curve(edges_10.Naked)

# ---- group: Dachbalken (continued)
edges_11 = BrepEdges(Brep=brep_7)  # -> Naked, graft(Interior), NonManifold
crv_44 = Curve(edges_11.Interior)
move_60 = Move(Geometry=crv_44, Motion=Z_111)  # -> Geometry, Transform
eval_4 = EvaluateCurve(Curve=reparameterize(move_60.Geometry), Parameter="0")  # -> Point, Tangent, Angle
join_8 = JoinCurves(Curves=crv_43, Preserve=False)
rulesrf_3 = RuledSurface(CurveA=crv_44, CurveB=move_60.Geometry)
pdecon = Deconstruct(Point=eval_4.Tangent)  # -> XComponent, YComponent, ZComponent
crv_45 = Curve(join_8)
move_61 = Move(Geometry=crv_45, Motion=Z_112)  # -> Geometry, Transform
vec_15 = VectorXYZ(XComponent=pdecon.XComponent, YComponent=pdecon.YComponent, ZComponent=0)  # -> Vector, Length
rotate_3 = Rotate(Geometry=vec_15.Vector, Angle=rad_5, Plane=xy_11)  # -> Geometry, Transform
multiplication_21 = Multiplication(A=rotate_3.Geometry, B=division_4)
extr_65 = Extrude(Base=move_61.Geometry, Direction=Z_113)
neg_35 = Negative(Value=multiplication_21)
flippsrf = FlipPolysurface(Polysurface=extr_65)  # -> Flipped, R
extr_66 = Extrude(Base=rulesrf_3, Direction=[neg_35, multiplication_21])
offsrf_3 = OffsetSurface(Surface=flippsrf.Flipped, Distance="1", BothSides=0, CreateSolid=True)
cap_5 = CapHoles(Brep=extr_66)
fastsunion = FastSolidUnion(Breps=flatten(cap_5), Tolerance=0.01, strictFastSolidUnion=True, trueIntFastSolidUnion=False)  # -> graft(Result)
fastsdiff_18 = FastSolidDifference(
    SubtractFrom=fastsunion,
    SubtractWith=offsrf_3,
    Tolerance=0.01,
    computeBBFastSolidDiff=True,
    retainFastSolidDiff=True,
    strictFastSolidDiff=True,
    trueIntFastSolidDiff=False)
extr_67 = Extrude(Base=brep_7, Direction=Z_114)
fastsdiff_19 = FastSolidDifference(
    SubtractFrom=fastsdiff_18,
    SubtractWith=extr_67,
    Tolerance=0.01,
    computeBBFastSolidDiff=True,
    retainFastSolidDiff=True,
    strictFastSolidDiff=True,
    trueIntFastSolidDiff=False)
data_86 = Data(fastsdiff_19)

# ----
larger_8 = LargerThan(FirstNumber=deg_2, SecondNumber="225")  # -> LargerThan, OrEqualTo
smaller_10 = SmallerThan(FirstNumber=deg_2, SecondNumber="315")  # -> SmallerThan, OrEqualTo
smaller_11 = SmallerThan(FirstNumber=deg_2, SecondNumber="135")  # -> SmallerThan, OrEqualTo
larger_9 = LargerThan(FirstNumber=deg_2, SecondNumber="45")  # -> LargerThan, OrEqualTo
and_4 = GateAnd(A=larger_8.LargerThan, B=smaller_10.OrEqualTo)
and_5 = GateAnd(A=larger_9.LargerThan, B=smaller_11.OrEqualTo)
or_2 = GateOr(A=and_5, B=and_4)
winkel_shuffler = GhPythonScript(Dachneigung_N_S=Slider(30, range=0..100), Dachneigung_O_W=Slider(90, range=0..90), O_W_True=or_2)  # -> out, Winkel_Liste; inputs O_W_True: tree of Boolean
# ---------- winkel_shuffler: Python ----------
__author__ = "mfls"
__version__ = "2024.07.26"

import rhinoscriptsyntax as rs
import ghpythonlib.treehelpers as th
import itertools

# Inputs
# Dachneigung_N_S: Dachneigung_N_S (in Degrees)
# Dachneigung_O_W: Dachneigung_O_W (in Degrees)
# O_W_True: O_W_True (a list with true or false)

Dachneigung_N_S = Dachneigung_N_S
Dachneigung_O_W = Dachneigung_O_W

def flatten(nested_list):
    flat_list = []
    for item in nested_list:
        if isinstance(item, list):
            flat_list.extend(flatten(item))
        else:
            flat_list.append(item)
    return flat_list

# Convert tree to list
O_W_True = th.tree_to_list(O_W_True)

# Flatten the nested list
O_W_True = flatten(O_W_True)

print(O_W_True)  # Debug print to check the flattened list
print(len(O_W_True))  # Debug print to check the length of the flattened list

# Initialize the internal list
Liste = []

# Iterate over the O_W_True list and append the appropriate value to Liste
for value in O_W_True:
    if value:
        Liste.append(Dachneigung_O_W)
        print("O_W added")
    else:
        Liste.append(Dachneigung_N_S)
        print("N_W added")

print(Liste)  # Debug print to check the final list

# Output the result
Winkel_Liste = th.list_to_tree(Liste)

print(Winkel_Liste)
# ---------- end winkel_shuffler ----------
rad_6 = Radians(Degrees=winkel_shuffler.Winkel_Liste)

# ----
# Credit: Laurent Delrieu
# 
# https://discourse.mcneel.com/u/laurent_delrieu/summary
# 
# Modified by Maximilian Schäfer to work with Rhino compute
modified_c = CSharpScript(polyline=simplify_3.Curve, angles=rad_6, type=list_2)  # -> out, roofs; inputs polyline: Polyline, angles: list of Double, type: Int32
# ---------- modified_c: C# usings ----------
using System.IO;
using System.Linq;
using System.Data;
using System.Drawing;
using System.Reflection;
using System.Windows.Forms;
using System.Xml;
using System.Xml.Linq;
using System.Runtime.InteropServices;

using Rhino.Collections;
using GH_IO;
using GH_IO.Serialization;
# ---------- modified_c: C# ----------
    //Medial Axis
    //Laurent Delrieu
    //31 / 12 / 2017
    //l.delrieu@neuf.fr

    if (angles.Count < (polyline.Count - 1))
    {
      double defaultAngle = Math.PI / 4;
      if (angles.Count > 0)
      {
        defaultAngle = angles[angles.Count - 1];
        Component.AddRuntimeMessage(GH_RuntimeMessageLevel.Warning, "Not enough angles, by default " + RhinoMath.ToDegrees(angles[angles.Count - 1]) + "° taken");
      }
      else
      {
        Component.AddRuntimeMessage(GH_RuntimeMessageLevel.Warning, "Not enough angles, by default 45° is taken");
      }

      for(int i = angles.Count ; i < (polyline.Count - 1); i++)
      {
        angles.Add(defaultAngle);
      }
    }
    roofs = SandDune(polyline, angles, type, false, true);
# ---------- modified_c: C# additional code ----------
  //Calculation of 45° roof with differents valley
  //Type = 0 => Round : Constant slope (sand)
  //Type = 1 => Butt  : Angular (roof)
  //Type = 2 => Square : Simple
  //Type = 3 => Ellipse : Constant slope (sand)
  public List<Brep> SandDune(Polyline polyline, List<double> angles, int type, bool isV6, bool parallel)
  {
    List<Brep> output = new List<Brep>();

    //By default round type
    if (type < 0) type = 0;
    if (type > 3) type = 0;

    if (polyline != null)
    {
      double tol = 0.01;
      bool isClosed = polyline.IsClosedWithinTolerance(tol);
      //Polyline is closed if not closed
      if (!isClosed)
      {
        polyline.Add(polyline[0]);
      }
      //Just in case
      polyline.CollapseShortSegments(tol * 2);
      Curve polylineCurve = polyline.ToNurbsCurve();

      //Definition of orientation of polyline
      int orientation = 1;
      if (isV6)
      {
        //CurveOrientation (inverted in RH5 vs RH6
        // Undefined          0 Orientation is undefined.
        // Clockwise         -1 The curve's orientation is clockwise in the xy plane.
        // CounterClockwise   1 The curve's orientation is counter clockwise in the xy plane
        CurveOrientation curveOrientation = polylineCurve.ClosedCurveOrientation(Plane.WorldXY);
        if (curveOrientation == CurveOrientation.Clockwise) orientation = -1;
        else orientation = 1;
      }
      else
      {
        //Use of classical surface calculation of polyline
        if (SurfaceOnXYplane(polyline) > 0)  orientation = -1;
        else orientation = 1;
      }

      //Bounding box calculation in order to have the max horizontal distances for the roofs surfaces (before cut)
      BoundingBox bb = polylineCurve.GetBoundingBox(false);
      double maxLength = bb.Diagonal.Length;

      //List of brep representing the roof before cut
      List<Brep> breps = new List<Brep>();
      //Side of roof
      for (int i = 0; i < (polyline.Count - 1); i++)
      {
        //Calculate direction of line
        Point3d p1 = polyline[i];
        Point3d p2 = polyline[(i + 1)];
        Vector3d direction12 = (p2 - p1) * orientation;
        direction12.Unitize();
        //Calculate a perpendicular
        Vector3d perp12 = Vector3d.CrossProduct(direction12, Vector3d.ZAxis);
        perp12.Unitize();
        //Because move is one unit horizontal (per12) + one unit in Z => 45°
        //if you want other angle put a coefficient on perp12 (0 => 90°)
        Vector3d move = perp12 * Math.Tan(Math.PI / 2 - angles[i]) + Vector3d.ZAxis;
        move *= maxLength;

        //Make a sweep
        var sweep = new Rhino.Geometry.SweepOneRail();
        sweep.AngleToleranceRadians = 0.0174533;
        sweep.ClosedSweep = false;
        sweep.SweepTolerance = 0.01;

        Brep[] sideBreps = sweep.PerformSweep(new LineCurve(p1, p1 + move), new LineCurve(p1, p2));
        if (sideBreps.Length > 0) breps.Add(sideBreps[0]);
      }

      //Valley parts of the roof
      for (int i = 0; i < (polyline.Count - 1); i++)
      {
        //Calculate direction of line
        int index;
        if (i == 0)
        {
          index = polyline.Count - 2;
        }
        else
        {
          index = i - 1;
        }
        Point3d p1 = polyline[index];
        Point3d p2 = polyline[i];
        Point3d p3 = polyline[i + 1];

        Vector3d direction12 = (p2 - p1);
        direction12.Unitize();
        Vector3d direction23 = (p3 - p2);
        direction23.Unitize();

        Brep rp = new Brep();
        //Round type
        if (type == 0)
        {
          rp = ValleyRound(p2, direction12, direction23, angles[index], angles[i], maxLength, orientation);
          if (rp.IsValid) breps.Add(rp);
        }
        //Butt type
        if (type == 1)
        {
          Brep[] vv = ValleyButt(p2, direction12, direction23, angles[index], angles[i], maxLength, orientation);
          if (vv.Length >= 2)
          {
            if (vv[0].IsValid) breps.Add(vv[0]);
            if (vv[1].IsValid) breps.Add(vv[1]);
          }
        }
        //Square type
        if (type == 2)
        {
          rp = ValleySquare(p2, direction12, direction23, angles[index], angles[i], maxLength, orientation);
          if (rp.IsValid) breps.Add(rp);
        }
        //Square type
        if (type == 3)
        {
          rp = ValleyRound2(p2, direction12, direction23, angles[index], angles[i], maxLength, orientation);
          if (rp.IsValid) breps.Add(rp);
        }
      }
      output = CutBreps(breps, tol, polylineCurve, parallel);
    }
    return output;
  }
  public Brep ValleyRound(Point3d p2, Vector3d v12, Vector3d v23, double angle12, double angle23, double maxLength, int orientation)
  {
    Brep output = new Brep();
    Vector3d vv = Vector3d.CrossProduct(v12, v23);
    if (vv.Z * orientation > 0)
    {
      Vector3d perp12 = Vector3d.CrossProduct(v12, Vector3d.ZAxis * orientation);
      perp12.Unitize();
      Vector3d move12 = perp12 * Math.Tan(Math.PI / 2 - angle12) + Vector3d.ZAxis;
      move12 *= maxLength;

      Vector3d perp23 = Vector3d.CrossProduct(v23, Vector3d.ZAxis * orientation);
      perp23.Unitize();
      Vector3d move23 = perp23 * Math.Tan(Math.PI / 2 - angle23) + Vector3d.ZAxis;
      move23 *= maxLength;

      Arc arc = new Arc(p2 + move12, v12, p2 + move23);

      var sweep = new Rhino.Geometry.SweepTwoRail();
      sweep.AngleToleranceRadians = 0.0174533;
      sweep.ClosedSweep = false;
      sweep.SweepTolerance = 0.01;

      Brep[] sideBreps = sweep.PerformSweep(new LineCurve(p2 + move12, p2), new LineCurve(p2 + move23, p2), arc.ToNurbsCurve());
      if (sideBreps.Length > 0) output = sideBreps[0];
    }
    return output;
  }

  //Butt valley
  public Brep ValleyRound2(Point3d p2, Vector3d v12, Vector3d v23, double angle12, double angle23, double maxLength, int orientation)
  {
    Brep output = new Brep();
    Vector3d vv = Vector3d.CrossProduct(v12, v23);
    if (vv.Z * orientation > 0)
    {
      Vector3d perp12 = Vector3d.CrossProduct(v12, Vector3d.ZAxis * orientation);
      perp12.Unitize();
      Vector3d move12 = perp12 * Math.Tan(Math.PI / 2 - angle12) + Vector3d.ZAxis;
      move12 *= maxLength;

      Vector3d perp23 = Vector3d.CrossProduct(v23, Vector3d.ZAxis * orientation);
      perp23.Unitize();
      Vector3d move23 = perp23 * Math.Tan(Math.PI / 2 - angle23) + Vector3d.ZAxis;
      move23 *= maxLength;

      // Arc arc = new Arc(p2 + move12, v12, p2 + move23);
      Line l12 = new Line(p2 + move12, v12);
      Line l23 = new Line(p2 + move23, v23);
      Point3d pmid = p2 + (move23 + move12) / 2;
      double a, b;
      if (Rhino.Geometry.Intersect.Intersection.LineLine(l12, l23, out a, out b, 0.01, false))
      {
        pmid = l12.PointAt(a);
      }
      else
      {
        MessageBox.Show("pas passage");
      }
      var sweep = new Rhino.Geometry.SweepTwoRail();
      sweep.AngleToleranceRadians = 0.0174533;
      sweep.ClosedSweep = false;
      sweep.SweepTolerance = 0.01;

      // Brep[] sideBreps = sweep.PerformSweep(new LineCurve(p2 + move12, p2), new LineCurve(p2 + move23, p2), arc.ToNurbsCurve());
      Brep[] sideBreps = sweep.PerformSweep(new LineCurve(p2 + move12, p2), new LineCurve(p2 + move23, p2), ThreePointsToArc(p2 + move12, pmid, p2 + move23));
      if (sideBreps.Length > 0) output = sideBreps[0];
    }
    return output;


  }


  //Butt valley
  public Brep[] ValleyButt(Point3d p2, Vector3d v12, Vector3d v23, double angle12, double angle23, double maxLength, int orientation)
  {
    Brep[] output = new Brep[2];
    output[0] = new Brep();
    output[1] = new Brep();

    Vector3d vv = Vector3d.CrossProduct(v12, v23);
    if (vv.Z * orientation > 0)
    {
      Vector3d perp12 = Vector3d.CrossProduct(v12, Vector3d.ZAxis * orientation);
      perp12.Unitize();
      Vector3d move12 = perp12 * Math.Tan(Math.PI / 2 - angle12) + Vector3d.ZAxis;
      move12 *= maxLength;

      Vector3d perp23 = Vector3d.CrossProduct(v23, Vector3d.ZAxis * orientation);
      perp23.Unitize();
      Vector3d move23 = perp23 * Math.Tan(Math.PI / 2 - angle23) + Vector3d.ZAxis;
      move23 *= maxLength;

      Line l12 = new Line(p2 + move12, v12);
      Line l23 = new Line(p2 + move23, v23);

      Point3d pmid = p2 + (move23 + move12) / 2;
      double a, b;
      if (Rhino.Geometry.Intersect.Intersection.LineLine(l12, l23, out a, out b, 0.01, false))
      {
        pmid = l12.PointAt(a);
      }
      var sweep = new Rhino.Geometry.SweepTwoRail();
      sweep.AngleToleranceRadians = 0.0174533;
      sweep.ClosedSweep = false;
      sweep.SweepTolerance = 0.01;

      Brep[] sideBreps = sweep.PerformSweep(new LineCurve(p2 + move12, p2), new LineCurve(pmid, p2), new LineCurve(p2 + move12, pmid));
      if (sideBreps.Length > 0) output[0] = sideBreps[0];

      sideBreps = sweep.PerformSweep(new LineCurve(pmid, p2), new LineCurve(p2 + move23, p2), new LineCurve(pmid, p2 + move23));
      if (sideBreps.Length > 0) output[1] = sideBreps[0];
    }
    return output;
  }

  //Square Valley
  public Brep ValleySquare(Point3d p2, Vector3d v12, Vector3d v23, double angle12, double angle23, double maxLength, int orientation)
  {
    Brep output = new Brep();
    Vector3d vv = Vector3d.CrossProduct(v12, v23);
    if (vv.Z * orientation > 0)
    {
      Vector3d perp12 = Vector3d.CrossProduct(v12, Vector3d.ZAxis * orientation);
      perp12.Unitize();
      Vector3d move12 = perp12 * Math.Tan(Math.PI / 2 - angle12) + Vector3d.ZAxis;
      move12 *= maxLength;

      Vector3d perp23 = Vector3d.CrossProduct(v23, Vector3d.ZAxis * orientation);
      perp23.Unitize();
      Vector3d move23 = perp23 * Math.Tan(Math.PI / 2 - angle23) + Vector3d.ZAxis;
      move23 *= maxLength;


      var sweep = new Rhino.Geometry.SweepTwoRail();
      sweep.AngleToleranceRadians = 0.0174533;
      sweep.ClosedSweep = false;
      sweep.SweepTolerance = 0.01;

      Brep[] sideBreps = sweep.PerformSweep(new LineCurve(p2 + move12, p2), new LineCurve(p2 + move23, p2), new LineCurve(p2 + move12, p2 + move23));
      if (sideBreps.Length > 0) output = sideBreps[0];
    }
    return output;
  }

  //Cut the roof complete surface with curves
  //Example here
  //  https://discourse.mcneel.com/t/splitting-a-brep-by-a-curve-rhinocommon/17435/2
  public List<Brep> CutBreps(List<Brep> breps, double tol, Curve curve, bool parallel)
  {
    List<Brep> output = new List<Brep>();

    if (parallel)
    {
      System.Threading.Tasks.Parallel.For(0, breps.Count,
        i => {
        List<Curve> curves = BrepsCurvesIntersection(breps, i, tol, parallel);

        List<Brep> bb = new List<Brep>();
        BrepFace bf = breps[i].Faces[0];
        Brep split = bf.Split(curves, tol);
        if (split != null)
        {
          foreach(BrepFace splitFace in split.Faces)
          {
            bb.Add(splitFace.DuplicateFace(false));
          }
        }
        output.AddRange(LowerBrep(bb, curve, tol));
        });
    }
    else
    {
      //Not parallel
      for (int i = 0; i < breps.Count; i++)
      {
        List<Curve> curves = BrepsCurvesIntersection(breps, i, tol, parallel);

        List<Brep> bb = new List<Brep>();
        BrepFace bf = breps[i].Faces[0];
        Brep split = bf.Split(curves, tol);
        if (split != null)
        {
          foreach(BrepFace splitFace in split.Faces)
          {
            bb.Add(splitFace.DuplicateFace(false));
          }
        }
        output.AddRange(LowerBrep(bb, curve, tol));
      }
    }
    return output;
  }

  //Determine the intersection between the roofs
  public List<Curve> BrepsCurvesIntersection(List<Brep> breps, int index, double tol, bool parallel)
  {
    List<Curve> output = new List<Curve> ();
    if (parallel)
    {
      System.Threading.Tasks.Parallel.For(0, breps.Count,
        i => {
        if (i != index)
        {
          Curve[] intersectionCurves;
          Point3d[] intersectionPoints;
          if (Rhino.Geometry.Intersect.Intersection.BrepBrep(breps[i], breps[index], tol, out intersectionCurves, out intersectionPoints))
          {
            foreach (Curve curve in intersectionCurves)
            {
              output.Add(curve);
            }
          }
        }
        });
    }
      //Not parallel
    else
    {
      for (int i = 0; i < (breps.Count - 0); i++)
      {
        if (i != index)
        {
          Curve[] intersectionCurves;
          Point3d[] intersectionPoints;
          if (Rhino.Geometry.Intersect.Intersection.BrepBrep(breps[i], breps[index], tol, out intersectionCurves, out intersectionPoints))
          {
            foreach (Curve curve in intersectionCurves)
            {
              output.Add(curve);
            }
          }
        }
      }
    }
    return output;
  }
  //Search for the lower breps, if brep touch the contour of the roof (roofCurve)
  public List<Brep> LowerBrep(List<Brep> breps, Curve roofCurve, double tol)
  {
    List<Brep> output = new List<Brep>();
    int index = -1;
    if (breps.Count == 1)
    {
      output.Add(breps[0]);
    }
    else
    {
      for (int i = 0; i < breps.Count; i++)
      {
        Curve[] overlapCurves;
        Point3d[] intersectionPoints;
        bool test = Rhino.Geometry.Intersect.Intersection.CurveBrep(roofCurve, breps[i], tol, out overlapCurves, out  intersectionPoints);

        if (test)
        {
          //If the overlap is on the curve it is the part we want
          if (overlapCurves.Length >= 1)
          {
            output.Add(breps[i]);
          }
          if (intersectionPoints.Length >= 1)
          {
            index = i;
          }
        }
      }
      //If there is just a point of contact, it must be a Valley
      if ((output.Count == 0) && (index != -1))
      {
        output.Add(breps[index]);
      }
    }
    return output;
  }
  //Calculate the surface of a flat closed polygon on XY plane
  //The polygon could be on whatever height (allowed by substraction of polyline[0])
  // Positive if CounterClockwise
  // Negative if Clockwise
  public double SurfaceOnXYplane(Polyline polyline)
  {
    Vector3d sum = Vector3d.Zero;
    for (int i = 0; i < (polyline.Count - 1); i++)
    {
      Vector3d cross = Vector3d.CrossProduct((Vector3d) (polyline[i] - polyline[0]), (Vector3d) (polyline[i + 1] - polyline[0]));
      sum = sum + cross;
    }
    return sum.Z;
  }

  public Curve ThreePointsToArc(Point3d p0, Point3d p1, Point3d p2)
  {
    List<Point3d> pts = new  List<Point3d>();
    pts.Add(p0);
    pts.Add(p1);
    pts.Add(p2);
    Rhino.Geometry.NurbsCurve nc = Rhino.Geometry.NurbsCurve.Create(false, 2, pts);
    Point4d p41 = new Point4d(p1);
    p41.W = 0.707107;
    nc.Points.SetPoint(1, p41);
    return nc;
  }
# ---------- end modified_c ----------

join_9 = BrepJoin(Breps=modified_c.roofs)  # -> Breps, Closed
item_7 = ListItem(List=join_9.Breps, Index=Slider(0, range=0..1), Wrap=True)
brep_8 = Brep(item_7)
edges_12 = BrepEdges(Brep=brep_8)  # -> Naked, Interior, NonManifold
debrep_5 = DeconstructBrep(Brep=brep_8)  # -> Faces, Edges, Vertices
crv_46 = Curve(edges_12.Interior)
crv_47 = Curve(crv_46)
extr_68 = Extrude(Base=crv_47, Direction=Z_86)
evalsrf_6 = EvaluateSurface(Surface=reparameterize(extr_68), Point=md_slider_7)  # -> Point, Normal, UDirection, VDirection, Frame
angle_3 = Angle(VectorA=evalsrf_6.Normal, VectorB=Y_5, Plane=xy_6)  # -> Angle, Reflex
deg_3 = Degrees(Radians=angle_3.Angle)
larger_10 = LargerThan(FirstNumber=deg_3, SecondNumber="225")  # -> LargerThan, OrEqualTo
smaller_12 = SmallerThan(FirstNumber=deg_3, SecondNumber="315")  # -> SmallerThan, OrEqualTo
smaller_13 = SmallerThan(FirstNumber=deg_3, SecondNumber="135")  # -> SmallerThan, OrEqualTo
larger_11 = LargerThan(FirstNumber=deg_3, SecondNumber="45")  # -> LargerThan, OrEqualTo
and_6 = GateAnd(A=larger_10.LargerThan, B=smaller_12.OrEqualTo)
and_7 = GateAnd(A=larger_11.LargerThan, B=smaller_13.OrEqualTo)
or_3 = GateOr(A=and_7, B=and_6)
cull_12 = CullPattern(List=crv_47, CullPattern=or_3)  # -> graft(List)
offset_37 = OffsetCurve(Curve=cull_12, Distance=neg_33, Plane=xy_8, Corners=1)
rulesrf_4 = RuledSurface(CurveA=cull_12, CurveB=offset_37)
srf_14 = Surface(rulesrf_4)
area_4 = Area(Geometry=srf_14)  # -> Area, Centroid
larger_12 = LargerThan(FirstNumber=area_4.Area, SecondNumber=Slider(0.1, range=0..0.1))  # -> LargerThan, OrEqualTo
cull_13 = CullPattern(List=srf_14, CullPattern=larger_12.LargerThan)
crv_48 = Curve(edges_12.Naked)
crv_49 = Curve(crv_48)
extr_69 = Extrude(Base=crv_49, Direction=Z_83)
evalsrf_7 = EvaluateSurface(Surface=reparameterize(extr_69), Point=md_slider_6)  # -> Point, Normal, UDirection, VDirection, Frame
angle_4 = Angle(VectorA=evalsrf_7.Normal, VectorB=Y_3, Plane=xy_4)  # -> Angle, Reflex
deg_4 = Degrees(Radians=angle_4.Angle)
larger_13 = LargerThan(FirstNumber=deg_4, SecondNumber="225")  # -> LargerThan, OrEqualTo
smaller_14 = SmallerThan(FirstNumber=deg_4, SecondNumber="315")  # -> SmallerThan, OrEqualTo
smaller_15 = SmallerThan(FirstNumber=deg_4, SecondNumber="135")  # -> SmallerThan, OrEqualTo
larger_14 = LargerThan(FirstNumber=deg_4, SecondNumber="45")  # -> LargerThan, OrEqualTo
and_8 = GateAnd(A=larger_13.LargerThan, B=smaller_14.OrEqualTo)
and_9 = GateAnd(A=larger_14.LargerThan, B=smaller_15.OrEqualTo)
or_4 = GateOr(A=and_9, B=and_8)
invbool_3 = InvertBoolean(Boolean=or_4)  # -> Inverted, Number
cull_14 = CullPattern(List=crv_49, CullPattern=invbool_3.Inverted)
len_6 = Length(Curve=cull_14)
divlength = DivideLength(Curve=cull_14, Length=Slider(0.4, range=0..1))  # -> Points, Tangents, Parameters
lng = ListLength(List=divlength.Points)  # -> flatten(Length)
division_5 = Division(A=len_6, B=lng)
srf_15 = Surface(debrep_5.Faces)
srf_16 = Surface(srf_15)
evalsrf_8 = EvaluateSurface(Surface=reparameterize(srf_16), Point=md_slider_8)  # -> Point, Normal, UDirection, VDirection, Frame
angle_5 = Angle(VectorA=evalsrf_8.Normal, VectorB=Y_4, Plane=xy_5)  # -> Angle, Reflex
deg_5 = Degrees(Radians=angle_5.Angle)
larger_15 = LargerThan(FirstNumber=deg_5, SecondNumber="225")  # -> LargerThan, OrEqualTo
smaller_16 = SmallerThan(FirstNumber=deg_5, SecondNumber="315")  # -> SmallerThan, OrEqualTo
smaller_17 = SmallerThan(FirstNumber=deg_5, SecondNumber="135")  # -> SmallerThan, OrEqualTo
larger_16 = LargerThan(FirstNumber=deg_5, SecondNumber="45")  # -> LargerThan, OrEqualTo
and_10 = GateAnd(A=larger_15.LargerThan, B=smaller_16.OrEqualTo)
and_11 = GateAnd(A=larger_16.LargerThan, B=smaller_17.OrEqualTo)
or_5 = GateOr(A=and_11, B=and_10)
invbool_4 = InvertBoolean(Boolean=or_5)  # -> Inverted, Number
cull_15 = CullPattern(List=srf_16, CullPattern=invbool_4.Inverted)
brep_9 = Brep(cull_15)
# Breps Nach Oben Roof
brep_10 = Brep(cull_15)
join_10 = BrepJoin(Breps=brep_9)  # -> Breps, Closed
# Breps Nach Oben Roof Joined
brep_11 = Brep(join_10.Breps)
edges_13 = BrepEdges(Brep=brep_11)  # -> Naked, Interior, NonManifold
crv_50 = Curve(edges_13.Naked)
move_62 = Move(Geometry=brep_10, Motion=Z_92)  # -> Geometry, Transform
move_63 = Move(Geometry=join_10.Breps, Motion=Z_88)  # -> Geometry, Transform
extr_70 = Extrude(Base=join_10.Breps, Direction=Z_88)
evalsrf_9 = EvaluateSurface(Surface=reparameterize(move_62.Geometry), Point="{0,1,0}")  # -> Point, Normal, UDirection, VDirection, Frame
contour = Contour(Shape=move_62.Geometry, Point=evalsrf_9.Point, Direction=evalsrf_9.UDirection, Distance=abstand_konterlattung)
brep_12 = Brep(move_63.Geometry)
offset_38 = OffsetCurve(Curve=contour, Distance=neg_25, Plane=xy_7, Corners=1)
move_64 = Move(Geometry=brep_12, Motion=Z_90)  # -> Geometry, Transform
extr_71 = Extrude(Base=brep_12, Direction=Z_90)
data_87 = Data(extr_71)
project = Project(Curve=offset_38, Brep=move_62.Geometry, Direction=Vector(0, 0, 1))
rulesrf_5 = RuledSurface(CurveA=flatten(project), CurveB=flatten(contour))
brep_13 = Brep(move_64.Geometry)
evalsrf_10 = EvaluateSurface(Surface=reparameterize(rulesrf_5), Point=md_slider_9)  # -> Point, Normal, UDirection, VDirection, Frame
move_65 = Move(Geometry=brep_13, Motion=Z_94)  # -> Geometry, Transform
extr_72 = Extrude(Base=brep_13, Direction=Z_94)
evalsrf_11 = EvaluateSurface(Surface=reparameterize(cull_15), Point="{0,1,0}")  # -> Point, Normal, UDirection, VDirection, Frame
data_88 = Data(extr_72)
multiplication_22 = Multiplication(A=evalsrf_10.Normal, B=num_123)
rev_3 = Reverse(Vector=multiplication_22)
brep_14 = Brep(move_65.Geometry)
extr_73 = Extrude(Base=rulesrf_5, Direction=rev_3)
contour_2 = Contour(Shape=cull_15, Point=evalsrf_11.Point, Direction=evalsrf_11.VDirection, Distance=division_5)
extr_74 = Extrude(Base=brep_14, Direction=Z_95)
item_8 = ListItem(List=extr_73, Index=0, Wrap=True)
data_89 = Data(extr_74)
bbox_2 = BoundingBox(Content=item_8, Plane=PlaneXY(0, 0, 0))  # -> Box, Box_2
offset_39 = OffsetCurve(Curve=contour_2, Distance=neg_26, Plane=xy_9, Corners=1)
debox_2 = DeconstructBox(Box=bbox_2.Box)  # -> Plane, X, Y, Z
rulesrf_6 = RuledSurface(CurveA=contour_2, CurveB=offset_39)
num_131 = Number(debox_2.Z)
ma_10 = MassAddition(Input=flatten([num_115, num_116, num_114, dicke_vorverdeckung_2, num_121, num_131]))  # -> Result, PartialResults
Z_117 = UnitZ(Factor=ma_10.Result)
extr_75 = Extrude(Base=crv_50, Direction=Z_117)
offsetbrep_3 = OffsetBrep(Brep=extr_75, OffsetDistance=neg_23, Solid=Toggle(True), SharpEdges=True, Tolerance=0.01)
offsetbrep_4 = OffsetBrep(Brep=extr_75, OffsetDistance=neg_24, Solid=Toggle(True), SharpEdges=True, Tolerance=0.01)  # -> flatten(Offset)
data_90 = Data(offsetbrep_3)
data_91 = Data(data_90)
mcol_3 = MeshColours(Mesh=data_91, Colours=colour_swatch_7)
mesh_3 = Mesh(mcol_3)
custom_preview_3 = CustomPreview(Geometry=data_91, Material=create_material_5)
fastsdiff_20 = FastSolidDifference(
    SubtractFrom=extr_73,
    SubtractWith=offsetbrep_4,
    Tolerance=0.01,
    computeBBFastSolidDiff=True,
    retainFastSolidDiff=True,
    strictFastSolidDiff=True,
    trueIntFastSolidDiff=False)
srf_17 = Surface(rulesrf_6)
brep_15 = Brep(srf_17)
move_66 = Move(Geometry=brep_15, Motion=Z_91)  # -> Geometry, Transform
extr_76 = Extrude(Base=move_66.Geometry, Direction=Z_93)
data_92 = Data([extr_76, fastsdiff_20])
srf_18 = Surface([srf_17, cull_13])
srf_19 = Surface(srf_18)
move_67 = Move(Geometry=srf_19, Motion=Z_87)  # -> Geometry, Transform
extr_77 = Extrude(Base=move_67.Geometry, Direction=Z_89)  # -> flatten(Extrusion)
fastsdiff_21 = FastSolidDifference(
    SubtractFrom=extr_70,
    SubtractWith=extr_77,
    Tolerance=0.01,
    computeBBFastSolidDiff=True,
    retainFastSolidDiff=True,
    strictFastSolidDiff=True,
    trueIntFastSolidDiff=False)
data_93 = Data(fastsdiff_21)
extr_78 = Extrude(Base=srf_18, Direction=Z_96)
data_94 = Data(extr_78)

# ---- group: Dachaufbau / Konterlattung
panel_515 = Panel("Addition Dachaufbau Höhe")
ma_11 = MassAddition(Input=[dicke_unterspannbahn_5, dicke_vorverdeckung_3, dicke_aufsparrendämmung])  # -> Result, PartialResults
num_132 = Number(num_26)
panel_517 = Panel("Verschiebung Geo Pfetten")
Z_118 = UnitZ(Factor=ma_11.Result)
Z_119 = UnitZ(Factor=num_132)

# ---- group: Dachaufbau (continued)
brep_16 = Brep(brep_7)
ma_12 = MassAddition(Input=[ma_11.Result, num_132])  # -> Result, PartialResults
Z_120 = UnitZ(Factor=ma_12.Result)
move_68 = Move(Geometry=brep_16, Motion=Z_108)  # -> Geometry, Transform
move_69 = Move(Geometry=move_68.Geometry, Motion=Z_109)  # -> Geometry, Transform
move_70 = Move(Geometry=brep_16, Motion=Z_120)  # -> Geometry, Transform
extr_79 = Extrude(Base=move_68.Geometry, Direction=Z_109)
extr_80 = Extrude(Base=brep_16, Direction=Z_108)
extr_81 = Extrude(Base=move_69.Geometry, Direction=Z_110)
data_95 = Data([extr_80, extr_81])
data_96 = Data(extr_79)

# ----
addition_20 = Addition(A=ma_12.Result, B=höhe_dachpfetten)  # disabled
neg_36 = Negative(Value=addition_20)  # disabled
Z_121 = UnitZ(Factor=neg_36)  # disabled
extr_82 = Extrude(Base=brep, Direction=Z_121)  # disabled
brep_17 = Brep(move_69.Geometry)
num_133 = Number(num_132)

# ---- group: Dachlatten (continued)
brep_18 = Brep(graft(srf_13))
len_7 = Length(Curve=crv_43)
divide_3 = DivideCurve(Curve=crv_43, Count=len_7, Kinks=False)  # -> Points, Tangents, Parameters
item_9 = ListItem(List=divide_3.Points, Index="0", Wrap=True)
item_10 = ListItem(List=divide_3.Points, Index="0", Wrap=True)
item_11 = ListItem(List=divide_3.Tangents, Index="0", Wrap=True)
dist_3 = Distance(PointA=item_10, PointB=divide_3.Points)
bnd_8 = Bounds(Numbers=dist_3)
dedom2num_3 = DeconstructDomain²(Domain=bnd_8)  # -> UMin, UMax, VMin, VMax
subtraction_17 = Subtraction(A=dedom2num_3.UMax, B=num_26)
dom_5 = ConstructDomain(DomainStart=0, DomainEnd=subtraction_17)
remap_4 = RemapNumbers(Value=dist_3, Source=bnd_8, Target=dom_5)  # -> Mapped, Clipped
item_12 = ListItem(List=remap_4.Mapped, Index="1", Wrap=True)
contour_3 = Contour(Shape=brep_18, Point=item_9, Direction=item_11, Distance=item_12)
eval_5 = EvaluateCurve(Curve=contour_3, Parameter="0")  # -> Point, Tangent, Angle
pdecon_2 = Deconstruct(Point=eval_5.Tangent)  # -> XComponent, YComponent, ZComponent
vec_16 = VectorXYZ(XComponent=pdecon_2.XComponent, YComponent=pdecon_2.YComponent, ZComponent=0)  # -> Vector, Length
rotate_4 = Rotate(Geometry=vec_16.Vector, Angle=rad_4, Plane=xy_10)  # -> Geometry, Transform
multiplication_23 = Multiplication(A=num_26, B=rotate_4.Geometry)
extr_83 = Extrude(Base=contour_3, Direction=multiplication_23)
extr_84 = Extrude(Base=extr_83, Direction=neg_31)
fastsdiff_22 = FastSolidDifference(
    SubtractFrom=extr_84,
    SubtractWith=graft(fastsdiff_19),
    Tolerance=0.01,
    computeBBFastSolidDiff=True,
    retainFastSolidDiff=True,
    strictFastSolidDiff=True,
    trueIntFastSolidDiff=False)

# ---- group: Zwischensparrendämmung und Cutoff für Dämmung (continued)
brep_19 = Brep(brep_7)
extr_85 = Extrude(Base=brep_19, Direction=neg_34)
fastsunion_2 = FastSolidUnion(Breps=flatten([fastsunion, extr_84]), Tolerance=0.01, strictFastSolidUnion=True, trueIntFastSolidUnion=False)  # -> graft(Result)
move_71 = Move(Geometry=brep_19, Motion=neg_34)  # -> Geometry, Transform
fastsdiff_23 = FastSolidDifference(
    SubtractFrom=extr_85,
    SubtractWith=fastsunion_2,
    Tolerance=0.01,
    computeBBFastSolidDiff=True,
    retainFastSolidDiff=True,
    strictFastSolidDiff=True,
    trueIntFastSolidDiff=False)
data_97 = Data(fastsdiff_23)

# ----
dach_brep_unterseite = Brep([move_71.Geometry, brep_8])
null_2 = NullItem(Item=dach_brep_unterseite)  # -> NullFlags, InvalidFlags, Description
invbool_5 = InvertBoolean(Boolean=null_2.NullFlags)  # -> Inverted, Number
cull_16 = CullPattern(List=dach_brep_unterseite, CullPattern=invbool_5.Inverted)  # -> flatten(List)
dach_brep_unterseite_2 = Brep([move_71.Geometry, brep_8])
dach_brep_unterseite_3 = Brep(cull_16)

# ---- group: Dachteil (continued)
brep_20 = Brep(dach_brep_unterseite_3)
split = SplitBrep(Brep=extr_56, Cutter=brep_20)
area_5 = Area(Geometry=split)  # -> Area, Centroid
bnd_9 = Bounds(Numbers=area_5.Area)
dedomain_6 = DeconstructDomain(Domain=bnd_9)  # -> Start, End
equals_7 = Equality(FirstNumber=area_5.Area, SecondNumber=dedomain_6.End)  # -> Equality, Inequality
cull_17 = CullPattern(List=split, CullPattern=equals_7.Inequality)
data_98 = Data(cull_17)

# ----
offsetbrep_5 = OffsetBrep(Brep=[extr_5, data_98], OffsetDistance=number_slider_3, Solid=Toggle(True), SharpEdges=True, Tolerance=0.01)
join_11 = BrepJoin(Breps=flatten(offsetbrep_5))  # -> Breps, Closed
dispatch_45 = Dispatch(List=join_11.Breps, DispatchPattern=bool_3)  # -> ListA, ListB
data_99 = Data([join_5.Breps, dispatch_45.ListB])
fastsdiff_24 = FastSolidDifference(
    SubtractFrom=data_99,
    SubtractWith=boxrec,
    Tolerance=0.01,
    computeBBFastSolidDiff=True,
    retainFastSolidDiff=True,
    strictFastSolidDiff=True,
    trueIntFastSolidDiff=False)
data_100 = Data(fastsdiff_24)
null_3 = NullItem(Item=dach_brep_unterseite_2)  # -> NullFlags, InvalidFlags, Description
invbool_6 = InvertBoolean(Boolean=null_3.NullFlags)  # -> Inverted, Number
cull_18 = CullPattern(List=dach_brep_unterseite_2, CullPattern=invbool_6.Inverted)  # -> flatten(List)
dach_brep_unterseite_4 = Brep(cull_18)

# ---- group: Dachteil (continued)
brep_21 = Brep(dach_brep_unterseite_3)
split_2 = SplitBrep(Brep=extr_57, Cutter=brep_21)
volume = Volume(Geometry=split_2)  # -> Volume, Centroid
bnd_10 = Bounds(Numbers=volume.Volume)
dedomain_7 = DeconstructDomain(Domain=bnd_10)  # -> Start, End
equals_8 = Equality(FirstNumber=volume.Volume, SecondNumber=dedomain_7.End)  # -> Equality, Inequality
cull_19 = CullPattern(List=split_2, CullPattern=equals_8.Inequality)
data_101 = Data(cull_19)

brep_22 = Brep(dach_brep_unterseite_3)
split_3 = SplitBrep(Brep=extr_58, Cutter=brep_22)
volume_2 = Volume(Geometry=split_3)  # -> Volume, Centroid
bnd_11 = Bounds(Numbers=volume_2.Volume)
dedomain_8 = DeconstructDomain(Domain=bnd_11)  # -> Start, End
equals_9 = Equality(FirstNumber=volume_2.Volume, SecondNumber=dedomain_8.End)  # -> Equality, Inequality
cull_20 = CullPattern(List=split_3, CullPattern=equals_9.Inequality)
data_102 = Data(cull_20)

brep_23 = Brep(dach_brep_unterseite_3)
split_4 = SplitBrep(Brep=extr_59, Cutter=brep_23)
volume_3 = Volume(Geometry=split_4)  # -> Volume, Centroid
bnd_12 = Bounds(Numbers=volume_3.Volume)
dedomain_9 = DeconstructDomain(Domain=bnd_12)  # -> Start, End
equals_10 = Equality(FirstNumber=volume_3.Volume, SecondNumber=dedomain_9.End)  # -> Equality, Inequality
cull_21 = CullPattern(List=split_4, CullPattern=equals_10.Inequality)
data_103 = Data(cull_21)

brep_24 = Brep(dach_brep_unterseite_3)
split_5 = SplitBrep(Brep=extr_60, Cutter=brep_24)
volume_4 = Volume(Geometry=split_5)  # -> Volume, Centroid
bnd_13 = Bounds(Numbers=volume_4.Volume)
dedomain_10 = DeconstructDomain(Domain=bnd_13)  # -> Start, End
equals_11 = Equality(FirstNumber=volume_4.Volume, SecondNumber=dedomain_10.End)  # -> Equality, Inequality
cull_22 = CullPattern(List=split_5, CullPattern=equals_11.Inequality)
data_104 = Data(cull_22)

brep_25 = Brep(dach_brep_unterseite_3)
split_6 = SplitBrep(Brep=extr_61, Cutter=brep_25)
volume_5 = Volume(Geometry=split_6)  # -> Volume, Centroid
bnd_14 = Bounds(Numbers=volume_5.Volume)
dedomain_11 = DeconstructDomain(Domain=bnd_14)  # -> Start, End
equals_12 = Equality(FirstNumber=volume_5.Volume, SecondNumber=dedomain_11.End)  # -> Equality, Inequality
cull_23 = CullPattern(List=split_6, CullPattern=equals_12.Inequality)
data_105 = Data(cull_23)

# ----
bcx = BrepCurve(Brep=dach_brep_unterseite_4, Curve=line, UseTasks=False)  # -> Curves, flatten(Points)
bcx_2 = BrepCurve(Brep=dach_brep_unterseite_4, Curve=line_2, UseTasks=False)  # -> Curves, flatten(Points)
dist_4 = Distance(PointA=midpt_3, PointB=bcx.Points)
dist_5 = Distance(PointA=midpt_5, PointB=bcx_2.Points)
brep_26 = Brep(dach_brep_unterseite_4)
bnd_15 = Bounds(Numbers=dist_4)
bnd_16 = Bounds(Numbers=dist_5)
extr_86 = Extrude(Base=brep_26, Direction=Z_9)
dedomain_12 = DeconstructDomain(Domain=bnd_16)  # -> Start, End
Z_122 = UnitZ(Factor=dedomain_12.Start)
bcx_3 = BrepCurve(Brep=dach_brep_unterseite_3, Curve=line_3, UseTasks=False)  # -> Curves, Points
dedomain_13 = DeconstructDomain(Domain=bnd_15)  # -> Start, End
brep_27 = Brep(dach_brep_unterseite_4)
brep_28 = Brep(dach_brep_unterseite_4)
fastsdiff_25 = FastSolidDifference(
    SubtractFrom=graft(extr_8),
    SubtractWith=extr_86,
    Tolerance=0.01,
    computeBBFastSolidDiff=True,
    retainFastSolidDiff=True,
    strictFastSolidDiff=True,
    trueIntFastSolidDiff=False)
dispatch_46 = Dispatch(List=Z_122, DispatchPattern=bool_3)  # -> ListA, ListB
brep_29 = Brep(dach_brep_unterseite_4)
extr_87 = Extrude(Base=brep_27, Direction=Z_16)
trim_8 = TrimTree(Tree=bcx_3.Points, Depth=1)
extr_88 = Extrude(Base=brep_28, Direction=Z_17)
extr_89 = Extrude(Base=brep_29, Direction=Z_18)
subtraction_18 = Subtraction(A=dedomain_13.Start, B=dedomain_12.Start)
fastsdiff_26 = FastSolidDifference(
    SubtractFrom=graft(extr_10),
    SubtractWith=extr_87,
    Tolerance=0.01,
    computeBBFastSolidDiff=True,
    retainFastSolidDiff=True,
    strictFastSolidDiff=True,
    trueIntFastSolidDiff=False)
Z_123 = UnitZ(Factor=dedomain_12.Start)
fastsdiff_27 = FastSolidDifference(
    SubtractFrom=graft(extr_12),
    SubtractWith=extr_88,
    Tolerance=0.01,
    computeBBFastSolidDiff=True,
    retainFastSolidDiff=True,
    strictFastSolidDiff=True,
    trueIntFastSolidDiff=False)
dist_6 = Distance(PointA=trim_8, PointB=midpt_4)
fastsdiff_28 = FastSolidDifference(
    SubtractFrom=graft(extr_11),
    SubtractWith=extr_89,
    Tolerance=0.01,
    computeBBFastSolidDiff=True,
    retainFastSolidDiff=True,
    strictFastSolidDiff=True,
    trueIntFastSolidDiff=False)
extr_90 = Extrude(Base=boundary_11, Direction=[dispatch_18.ListA, dispatch_46.ListB])
move_72 = Move(Geometry=boundary_11, Motion=Z_123)  # -> Geometry, Transform
dispatch_47 = Dispatch(List=[data_101, extr_15], DispatchPattern=bool_3)  # -> ListA, ListB
fastsdiff_29 = FastSolidDifference(
    SubtractFrom=graft(fastsdiff_25),
    SubtractWith=data_26,
    Tolerance=0.01,
    computeBBFastSolidDiff=True,
    retainFastSolidDiff=True,
    strictFastSolidDiff=True,
    trueIntFastSolidDiff=False)
Z_124 = UnitZ(Factor=subtraction_18)
bnd_17 = Bounds(Numbers=dist_6)
dispatch_48 = Dispatch(List=[extr_14, data_103], DispatchPattern=bool_3)  # -> ListA, ListB
dispatch_49 = Dispatch(List=[extr_18, data_102], DispatchPattern=bool_3)  # -> ListA, ListB
dispatch_50 = Dispatch(List=[data_104, extr_19], DispatchPattern=bool_3)  # -> ListA, ListB
bcx_4 = BrepCurve(Brep=dach_brep_unterseite_3, Curve=line_4, UseTasks=False)  # -> Curves, flatten(Points)
bcx_5 = BrepCurve(Brep=dach_brep_unterseite_3, Curve=line_5, UseTasks=False)  # -> Curves, flatten(Points)
dedomain_14 = DeconstructDomain(Domain=bnd_17)  # -> Start, End
fastsdiff_30 = FastSolidDifference(
    SubtractFrom=graft(fastsdiff_26),
    SubtractWith=data_26,
    Tolerance=0.01,
    computeBBFastSolidDiff=True,
    retainFastSolidDiff=True,
    strictFastSolidDiff=True,
    trueIntFastSolidDiff=False)
dispatch_51 = Dispatch(List=[extr_20, data_105], DispatchPattern=bool_3)  # -> ListA, ListB
fastsdiff_31 = FastSolidDifference(
    SubtractFrom=graft(fastsdiff_27),
    SubtractWith=data_26,
    Tolerance=0.01,
    computeBBFastSolidDiff=True,
    retainFastSolidDiff=True,
    strictFastSolidDiff=True,
    trueIntFastSolidDiff=False)
extr_91 = Extrude(Base=move_72.Geometry, Direction=Z_124)
fastsdiff_32 = FastSolidDifference(
    SubtractFrom=graft(fastsdiff_28),
    SubtractWith=data_26,
    Tolerance=0.01,
    computeBBFastSolidDiff=True,
    retainFastSolidDiff=True,
    strictFastSolidDiff=True,
    trueIntFastSolidDiff=False)
fastsdiff_33 = FastSolidDifference(
    SubtractFrom=graft(extr_90),
    SubtractWith=data_26,
    Tolerance=0.01,
    computeBBFastSolidDiff=True,
    retainFastSolidDiff=True,
    strictFastSolidDiff=True,
    trueIntFastSolidDiff=False)
dist_7 = Distance(PointA=midpt_6, PointB=bcx_4.Points)
dist_8 = Distance(PointA=midpt_7, PointB=bcx_5.Points)
fastsdiff_34 = FastSolidDifference(
    SubtractFrom=graft(dispatch_47.ListB),
    SubtractWith=data_26,
    Tolerance=0.01,
    computeBBFastSolidDiff=True,
    retainFastSolidDiff=True,
    strictFastSolidDiff=True,
    trueIntFastSolidDiff=False)
data_106 = Data([fastsdiff_29, fastsdiff_3])
fastsdiff_35 = FastSolidDifference(
    SubtractFrom=graft(dispatch_48.ListB),
    SubtractWith=data_26,
    Tolerance=0.01,
    computeBBFastSolidDiff=True,
    retainFastSolidDiff=True,
    strictFastSolidDiff=True,
    trueIntFastSolidDiff=False)
dispatch_52 = Dispatch(List=dedomain_14.Start, DispatchPattern=bool_3)  # -> ListA, ListB
fastsdiff_36 = FastSolidDifference(
    SubtractFrom=graft(dispatch_49.ListB),
    SubtractWith=data_26,
    Tolerance=0.01,
    computeBBFastSolidDiff=True,
    retainFastSolidDiff=True,
    strictFastSolidDiff=True,
    trueIntFastSolidDiff=False)
fastsdiff_37 = FastSolidDifference(
    SubtractFrom=graft(dispatch_50.ListB),
    SubtractWith=data_26,
    Tolerance=0.01,
    computeBBFastSolidDiff=True,
    retainFastSolidDiff=True,
    strictFastSolidDiff=True,
    trueIntFastSolidDiff=False)
bnd_18 = Bounds(Numbers=dist_7)
bnd_19 = Bounds(Numbers=dist_8)
data_107 = Data([fastsdiff_30, fastsdiff_2])
data_108 = Data([fastsdiff_31, fastsdiff_5])
fastsdiff_38 = FastSolidDifference(
    SubtractFrom=graft(dispatch_51.ListB),
    SubtractWith=data_26,
    Tolerance=0.01,
    computeBBFastSolidDiff=True,
    retainFastSolidDiff=True,
    strictFastSolidDiff=True,
    trueIntFastSolidDiff=False)
dedomain_15 = DeconstructDomain(Domain=bnd_18)  # -> Start, End
dedomain_16 = DeconstructDomain(Domain=bnd_19)  # -> Start, End
data_109 = Data([fastsdiff_35, fastsdiff_8])
data_110 = Data([fastsdiff_34, fastsdiff_7])
data_111 = Data([data_107, data_79, data_60, data_110])

# ---- group: Recompute (continued)
edges_14 = BrepEdges(Brep=data_111)  # -> Naked, Interior, NonManifold; disabled
cp = ControlPoints(Curve=edges_14.Interior)  # -> Points, Weights, Knots; disabled
srf_cp_2 = SurfaceClosestPoint(Point=cp.Points, Surface=srf_6)  # -> Point, UVPoint, flatten(Distance); disabled
bnd_20 = Bounds(Numbers=srf_cp_2.Distance)  # disabled
dedomain_17 = DeconstructDomain(Domain=bnd_20)  # -> Start, End; disabled
smaller_18 = SmallerThan(FirstNumber=dedomain_17.Start, SecondNumber=number_slider_7)  # -> SmallerThan, OrEqualTo; disabled
panel_519 = Panel(smaller_18.SmallerThan)  # disabled

# ---- group: Recompute / Recompute Solution
rs = RecomputeSolution(Recompute=smaller_18.SmallerThan)  # disabled
# ---------- rs: Python ----------
"""
Recomputes the Grasshopper solution (ala pressing F5).
    Inputs:
        Recompute: Trigger the component using a False-True Button {item,bool}
    Outputs:
    Remarks:
        Author: Anders Holden Deleuran (BIG IDEAS)
        License:
        Rhino: 6.18.19266.14201
        Version: 191001
"""

ghenv.Component.Name = "RecomputeSolution"
ghenv.Component.NickName = "RS"

if Recompute:
    def recomputeCanvas(e):
        for obj in ghenv.Component.OnPingDocument().Objects:
            if not obj.InstanceGuid == ghenv.Component.InstanceGuid:
                obj.ExpireSolution(False)
                
    ghenv.Component.OnPingDocument().ScheduleSolution(1000,recomputeCanvas)
# ---------- end rs ----------

# ----
mcol_4 = MeshColours(Mesh=data_111, Colours=colour_swatch_8)
mesh_4 = Mesh(mcol_4)
custom_preview_4 = CustomPreview(Geometry=data_111, Material=create_material_6)
data_112 = Data([fastsdiff_32, fastsdiff_4])
data_113 = Data([fastsdiff_36, fastsdiff_9])
data_114 = Data([data_108, data_76, data_57, data_53, data_113, data_78, data_95, data_80, data_69, data_87, data_89])
mcol_5 = MeshColours(Mesh=data_114, Colours=colour_swatch_3)
mesh_5 = Mesh(mcol_5)
custom_preview_5 = CustomPreview(Geometry=data_114, Material=create_material_4)
Z_125 = UnitZ(Factor=dispatch_52.ListB)
data_115 = Data([fastsdiff_38, fastsdiff_6])
data_116 = Data([data_106, data_100, data_115])
mcol_6 = MeshColours(Mesh=data_116, Colours=colour_swatch_9)
mesh_6 = Mesh(mcol_6)
custom_preview_6 = CustomPreview(Geometry=data_116, Material=create_material_8)
dispatch_53 = Dispatch(List=data_112, DispatchPattern=smaller_6.OrEqualTo)  # -> ListA, ListB
data_117 = Data([fastsdiff_37, fastsdiff_10])
subtraction_19 = Subtraction(A=dedomain_15.Start, B=dedomain_16.Start)
# Extrusions höhe Dämmung minus Ringbalken höhe
subtraction_20 = Subtraction(A=dedomain_15.Start, B=subtraction_19)
Z_126 = UnitZ(Factor=subtraction_20)
Z_127 = UnitZ(Factor=dedomain_16.Start)
Z_128 = UnitZ(Factor=dedomain_16.Start)
dispatch_54 = Dispatch(List=Z_126, DispatchPattern=bool_3)  # -> ListA, ListB
move_73 = Move(Geometry=boundary_12, Motion=Z_127)  # -> Geometry, Transform
Z_129 = UnitZ(Factor=subtraction_19)

# ---- group: Dachteil (continued)
srf_20 = Surface(move_73.Geometry)
vec_17 = Vector(Z_129)
move_74 = Move(Geometry=srf_20, Motion=vec_17)  # -> Geometry, Transform
extr_92 = Extrude(Base=move_74.Geometry, Direction=Z_103)
brep_30 = Brep(dach_brep_unterseite_3)
split_7 = SplitBrep(Brep=extr_92, Cutter=brep_30)
volume_6 = Volume(Geometry=split_7)  # -> Volume, Centroid
bnd_21 = Bounds(Numbers=volume_6.Volume)
dedomain_18 = DeconstructDomain(Domain=bnd_21)  # -> Start, End
equals_13 = Equality(FirstNumber=volume_6.Volume, SecondNumber=dedomain_18.End)  # -> Equality, Inequality
cull_24 = CullPattern(List=split_7, CullPattern=equals_13.Inequality)
data_118 = Data(cull_24)

# ----
dispatch_55 = Dispatch(List=Z_128, DispatchPattern=bool_3)  # -> ListA, ListB
data_119 = Data(dispatch_53.ListB)
extr_93 = Extrude(Base=move_22.Geometry, Direction=dispatch_54.ListB)
extr_94 = Extrude(Base=move_73.Geometry, Direction=Z_129)
cap_6 = CapHoles(Brep=extr_93)
extr_95 = Extrude(Base=boundary_12, Direction=dispatch_55.ListB)

# ---- group: Beton bei Satteldach (continued)
brep_31 = Brep(dach_brep_unterseite_4)
extr_96 = Extrude(Base=brep_31, Direction=Z_9)
fastsdiff_39 = FastSolidDifference(
    SubtractFrom=graft(extr_62),
    SubtractWith=extr_96,
    Tolerance=0.01,
    computeBBFastSolidDiff=True,
    retainFastSolidDiff=True,
    strictFastSolidDiff=True,
    trueIntFastSolidDiff=False)

# ----
fastsdiff_40 = FastSolidDifference(
    SubtractFrom=graft(extr_94),
    SubtractWith=data_26,
    Tolerance=0.01,
    computeBBFastSolidDiff=True,
    retainFastSolidDiff=True,
    strictFastSolidDiff=True,
    trueIntFastSolidDiff=False)
fastsdiff_41 = FastSolidDifference(
    SubtractFrom=graft(cap_6),
    SubtractWith=data_26,
    Tolerance=0.01,
    UseTasks=False,
    computeBBFastSolidDiff=True,
    retainFastSolidDiff=True,
    strictFastSolidDiff=True,
    trueIntFastSolidDiff=False)
dispatch_56 = Dispatch(List=[extr_26, data_118], DispatchPattern=bool_3)  # -> ListA, ListB
extr_97 = Extrude(Base=move_23.Geometry, Direction=Z_125)
data_120 = Data(fastsdiff_40)

# ---- group: Satteldach Randbalken (continued)
fastsdiff_42 = FastSolidDifference(
    SubtractFrom=extr_91,
    SubtractWith=flatten(extr_63),
    Tolerance=0.01,
    computeBBFastSolidDiff=True,
    retainFastSolidDiff=True,
    strictFastSolidDiff=True,
    trueIntFastSolidDiff=False)

# ----
fastsdiff_43 = FastSolidDifference(
    SubtractFrom=graft(dispatch_56.ListB),
    SubtractWith=data_26,
    Tolerance=0.01,
    computeBBFastSolidDiff=True,
    retainFastSolidDiff=True,
    strictFastSolidDiff=True,
    trueIntFastSolidDiff=False)
cap_7 = CapHoles(Brep=extr_97)
data_121 = Data([fastsdiff_41, fastsdiff_11])
fastsdiff_44 = FastSolidDifference(
    SubtractFrom=extr_95,
    SubtractWith=data_121,
    Tolerance=0.01,
    computeBBFastSolidDiff=True,
    retainFastSolidDiff=True,
    strictFastSolidDiff=True,
    trueIntFastSolidDiff=False)
fastsdiff_45 = FastSolidDifference(
    SubtractFrom=graft(fastsdiff_44),
    SubtractWith=data_26,
    Tolerance=0.01,
    computeBBFastSolidDiff=True,
    retainFastSolidDiff=True,
    strictFastSolidDiff=True,
    trueIntFastSolidDiff=False)
dispatch_57 = Dispatch(List=extr_91, DispatchPattern=bool_14)  # -> ListA, ListB
dispatch_58 = Dispatch(List=fastsdiff_42, DispatchPattern=bool_14)  # -> ListA, ListB
data_122 = Data([fastsdiff_43, fastsdiff_45])
data_123 = Data([data_119, data_77, data_61, data_55, data_109, data_73, data_122, data_66, data_96, data_97, data_93, data_88])
mcol_7 = MeshColours(Mesh=data_123, Colours=colour_swatch_6)
mesh_7 = Mesh(mcol_7)
custom_preview_7 = CustomPreview(Geometry=data_123, Material=create_material_3)
data_124 = Data([fastsdiff_33, fastsdiff_39])
fastsdiff_46 = FastSolidDifference(
    SubtractFrom=graft(cap_7),
    SubtractWith=data_26,
    Tolerance=0.01,
    computeBBFastSolidDiff=True,
    retainFastSolidDiff=True,
    strictFastSolidDiff=True,
    trueIntFastSolidDiff=False)
data_125 = Data([dispatch_57.ListA, dispatch_58.ListB])
dispatch_59 = Dispatch(List=data_124, DispatchPattern=bool_15)  # -> ListA, ListB
dispatch_60 = Dispatch(List=fastsdiff_33, DispatchPattern=bool_15)  # -> ListA, ListB
data_126 = Data(fastsdiff_46)
data_127 = Data([dispatch_60.ListB, dispatch_59.ListA])
dispatch_61 = Dispatch(List=data_127, DispatchPattern=bool_7)  # -> ListA, ListB
data_128 = Data(dispatch_61.ListB)
data_129 = Data([data_128, data_74, data_58, data_54, data_52, data_75, data_67])
mcol_8 = MeshColours(Mesh=data_129, Colours=colour_swatch_4)
mesh_8 = Mesh(mcol_8)
custom_preview_8 = CustomPreview(Geometry=data_129, Material=create_material)

# ---- group: Dachaufbau / Konterlattung (continued)
move_75 = Move(Geometry=extr_83, Motion=Z_118)  # -> Geometry, Transform
konterlattung = Extrude(Base=move_75.Geometry, Direction=Z_119)
bbox_3 = BoundingBox(Content=konterlattung, Plane=PlaneXY(0, 0, 0))  # -> Box, Box_2
boxprop = BoxProperties(Box=bbox_3.Box)  # -> Center, Diagonal, Area, Volume, Degeneracy
larger_17 = LargerThan(FirstNumber=boxprop.Volume, SecondNumber="0.001")  # -> LargerThan, OrEqualTo
cull_25 = CullPattern(List=konterlattung, CullPattern=larger_17.LargerThan)
data_130 = Data(cull_25)

# ---- group: Dachlattung
panel_520 = Panel("Randkurven Dach (Knicke)")
debrep_6 = DeconstructBrep(Brep=move_70.Geometry)  # -> Faces, Edges, Vertices
edges_15 = BrepEdges(Brep=move_70.Geometry)  # -> Naked, Interior, NonManifold
join_12 = JoinCurves(Curves=edges_15.Naked, Preserve=False)
crv_51 = Curve(join_12)
panel_522 = Panel("Dach Surface Sortiert")
eval_6 = EvaluateCurve(Curve=reparameterize(crv_51), Parameter="0")  # -> Point, Tangent, Angle
srf_21 = Surface(srf_13)
x_size = Slider(0.2, range=0..1)
panel_523 = Panel("Dimension Dachziegeln")
dachlattung_dimensionen = Slider(0.06, range=0..0.1)
Z_130 = UnitZ(Factor=1)
md_slider_10 = MDSlider(SliderMode=0, slider_value=Point(0.5, 0.5, 0.5), x_domain=Domain(0, 1), y_domain=Domain(0, 1), z_domain=Domain(0, 1))
panel_524 = Panel("Contour Dachpfetten")
trim_9 = TrimTree(Tree=contour_3, Depth=1)
eval_7 = EvaluateCurve(Curve=reparameterize(trim_9), Parameter="0")  # -> Point, Tangent, Angle
unit = UnitVector(Vector=eval_7.Tangent)
multiplication_24 = Multiplication(A=unit, B=dachlattung_dimensionen)
Z_131 = UnitZ(Factor=num_132)

# ----
move_76 = Move(Geometry=srf_21, Motion=Z_120)  # -> Geometry, Transform

# ---- group: Dachlattung (continued)
contour_4 = Contour(Shape=move_76.Geometry, Point=eval_6.Point, Direction=Z_130, Distance=x_size)
trim_10 = TrimTree(Tree=contour_4, Depth=1)
brep_32 = Brep(graft(move_76.Geometry))
evalsrf_12 = EvaluateSurface(Surface=reparameterize(brep_32), Point=md_slider_10)  # -> Point, Normal, UDirection, VDirection, Frame
neg_37 = Negative(Value=evalsrf_12.Normal)
multiplication_25 = Multiplication(A=neg_37, B=dachlattung_dimensionen)
extr_98 = Extrude(Base=trim_10, Direction=multiplication_25)
extr_99 = Extrude(Base=extr_98, Direction=multiplication_24)
cull_i = CullIndex(List=extr_99, Indices="0", Wrap=True)
move_77 = Move(Geometry=cull_i, Motion=Z_131)  # -> Geometry, Transform
item_13 = ListItem(List=flatten(move_77.Geometry), Index="0", Wrap=True)
bbox_4 = BoundingBox(Content=item_13, Plane=PlaneXY(0, 0, 0))  # -> Box, Box_2
debox_3 = DeconstructBox(Box=bbox_4.Box)  # -> Plane, X, Y, Z
data_131 = Data(move_77.Geometry)
num_134 = Number(debox_3.Z)

# ----
num_135 = Number(num_134)
addition_21 = Addition(A=num_135, B=num_133)
Z_132 = UnitZ(Factor=addition_21)
move_78 = Move(Geometry=brep_17, Motion=Z_132)  # -> Geometry, Transform
debrep_7 = DeconstructBrep(Brep=move_78.Geometry)  # -> Faces, Edges, Vertices
extr_100 = Extrude(Base=debrep_7.Faces, Direction=Z_84)

# ---- group: Dachlatten (continued)
fastsdiff_47 = FastSolidDifference(
    SubtractFrom=fastsdiff_22,
    SubtractWith=extr_91,
    Tolerance=0.01,
    computeBBFastSolidDiff=True,
    retainFastSolidDiff=True,
    strictFastSolidDiff=True,
    trueIntFastSolidDiff=False)

# ----
bbox_5 = BoundingBox(Content=fastsdiff_47, Plane=PlaneXY(0, 0, 0))  # -> Box, Box_2
boxprop_2 = BoxProperties(Box=bbox_5.Box)  # -> Center, Diagonal, Area, Volume, Degeneracy
larger_18 = LargerThan(FirstNumber=boxprop_2.Volume, SecondNumber="0.001")  # -> LargerThan, OrEqualTo
cull_26 = CullPattern(List=fastsdiff_47, CullPattern=larger_18.LargerThan)

# ---- group: Dachlatten (continued)
data_132 = Data(cull_26)

# ----
data_133 = Data([data_125, data_62, data_126, data_51, data_33, data_117, data_121, data_120, data_35, data_86, data_65, data_130, data_132, data_131, data_94, data_92])
mcol_9 = MeshColours(Mesh=data_133, Colours=colour_swatch_5)
mesh_9 = Mesh(mcol_9)
data_134 = Data(simplify(flatten([mesh_8, mesh_9, mesh_7, mesh_5, mesh_6, mesh_3, mesh_4, mesh_2, mesh])))
mesh_10 = Mesh(data_134)
null_4 = NullItem(Item=mesh_10)  # -> NullFlags, InvalidFlags, Description
invbool_7 = InvertBoolean(Boolean=null_4.NullFlags)  # -> Inverted, Number
custom_preview_9 = CustomPreview(Geometry=data_133, Material=create_material_2)
cull_27 = CullPattern(List=mesh_10, CullPattern=invbool_7.Inverted)
mesh_11 = Mesh(simplify(graft(cull_27)))
context_bake = ContextBake(Geometry=mesh_11)
panel_527 = Panel(mesh_11)

# ==== cluster Cluster
crv = ClusterInput()
crv_2 = ClusterInput()
txt = ClusterInput()
txt_2 = ClusterInput()
brep = ClusterInput()
brep_2 = ClusterInput()
int = ClusterInput()

crv_3 = Curve(crv)
crv_4 = Curve(crv_2)

txt_3 = Text(txt)
txt_4 = Text(txt_2)
brep_3 = Brep(brep)
brep_4 = Brep(brep_2)
int_2 = Integer(int)
number_slider = Slider(0.139, range=0..10)
swatch = ColourSwatch(SwatchColor=RGB(0, 0, 0))
dash = DashPattern(Curve=crv_4, Pattern=[Slider(0.513, range=0..10), Slider(0.547, range=0..10)])  # -> Dashes, Gaps
previewlw = CustomPreviewLineweights(Geometry=dash.Dashes, Shader=swatch, Thickness=number_slider, Absolute=True)
previewlw_2 = CustomPreviewLineweights(Geometry=crv_3, Shader=swatch, Thickness=number_slider, Absolute=True)
txt_5 = Text(txt_4)
trim = TextTrim(Text=txt_3, Start=True, End=True)
len = TextLength(Text=txt_5)
min = Minimum(A="8", B=len)
fragment = TextFragment(Text=txt_5, Start="0", Count=min)
tmatch = MatchText(Text=fragment, Pattern="&&HALL&&", Case=True)
long = LongestList(ListA=tmatch, ListB="0", ListC="8", PaddingMode=2)  # -> ListA, ListB, ListC
brep_5 = Brep(brep_4)
brep_6 = Brep(brep_3)
p_n_c = PickNChoose(Pattern=tmatch, Stream0=long.ListB, Stream1=long.ListC)
fragment_2 = TextFragment(Text=txt_5, Start=p_n_c)
lng = ListLength(List=brep_6)
division = Division(A=".8", B=lng)
join = BrepJoin(Breps=flatten([brep_5, brep_6]))  # -> Breps, Closed
series = Series(Start=0, Step=division, Count=lng)
txt_6 = Text(fragment_2)
addition = Addition(A=series, B=Slider(0.704, range=0..1))
edges = BrepEdges(Brep=join.Breps)  # -> Naked, Interior, NonManifold
number_slider_2 = Slider(0.045, range=0..4)
crv_5 = Curve(edges.Naked)
area = Area(Geometry=brep_6)  # -> Area, Centroid
long_2 = LongestList(ListA=tmatch, ListB=Slider(0.656, range=0..1), ListC="1", PaddingMode=2)  # -> ListA, ListB, ListC
join_2 = JoinCurves(Curves=crv_5, Preserve=False)
crv_6 = Curve(simplify(brep_6))
p_n_c_2 = PickNChoose(Pattern=tmatch, Stream0=long_2.ListB, Stream1=long_2.ListC)
offset = Offset(Curve=flatten(join_2), Distance=expr("x/2", number_slider_2), Plane=PlaneXY(0, 0, 0), Corners=1)
screentext = ScreenOrientedText(Text=txt_6, Justification=7, Location=area.Centroid, SizeFactor=Slider(8, range=0..100), Depth=0, Absolute=False)
hsl = ColourHSL(Alpha=1, Hue=0, Saturation=0, Luminance=Slider(1, range=0..1))
hsl_2 = ColourHSL(Alpha=1, Hue=addition, Saturation=1, Luminance=p_n_c_2)
subtraction = Subtraction(A=hsl_2, B=ColourSwatch(SwatchColor=RGB(71, 71, 71)))  # -> simplify(Result)
previewmat = CustomPreviewMaterials(Geometry=brep_5, DiffuseColor=hsl)
previewlw_3 = CustomPreviewLineweights(Geometry=flatten(offset), Shader=ColourSwatch(SwatchColor=RGB(0, 0, 0)), Thickness=number_slider_2, Absolute=True)
previewlw_4 = CustomPreviewLineweights(Geometry=crv_6, Shader=subtraction, Thickness=Slider(0.069, range=0..4), Absolute=True)
previewmat_2 = CustomPreviewMaterials(Geometry=brep_6, DiffuseColor=hsl_2)

# ==== cluster FensterGenerator
kurven_himmelsrichtung = ClusterInput()
kurven_himmelsrichtung_2 = Curve(kurven_himmelsrichtung)
panel = Panel("Dicke Wandaufbau Innenände")
end = EndPoints(Curve=kurven_himmelsrichtung_2)  # -> Start, End
panel_2 = Panel("Punkte Innenwände")
panel_3 = Panel("Dicke Wandaufbau")
num = ClusterInput()
pt = ClusterInput()
num_2 = ClusterInput()
pt_2 = Point([end.Start, end.End])
num_3 = Number(num)
pt_3 = Point(pt)
num_4 = Number(num_2)
sph = Sphere(Base=pt_2, Radius=num_3)
sph_2 = Sphere(Base=pt_3, Radius=num_4)
wwr_himmelsrichtung = ClusterInput()
data = Data(flatten([sph, sph_2]))
num_5 = ClusterInput()
panel_4 = Panel("Augenhöhe")
trim = TrimWithBreps(Curve=kurven_himmelsrichtung_2, Brep=data)  # -> Inside, graft(Outside)
panel_5 = Panel("Raumhöhe")
mindestbreite_fenster = Slider(0.3, range=-0.3..0.7)
crv = Curve(trim.Outside)
wwr_himmelsrichtung_2 = Number(Slider(0.424, range=0..1))
num_6 = Number(num_5)
num_7 = Number("1.6")
len = Length(Curve=crv)
subtraction = Subtraction(A=num_6, B=num_7)
graph = GraphMapper(wwr_himmelsrichtung_2, x0=0, x1=1, y0=0, y1=1, container_name="Bezier", cpx=[0, 0, 0.4891056716, 1], cpy=[0, 0, 1, 1])
graph_2 = GraphMapper(
    wwr_himmelsrichtung_2,
    x0=0,
    x1=1,
    y0=0,
    y1=1,
    container_name="Bezier",
    cpx=[0, 0.7343276143, 0, 1],
    cpy=[0, 0.2606632113, 0.6169146299, 1])
larger = LargerThan(FirstNumber=len, SecondNumber=mindestbreite_fenster)  # -> LargerThan, OrEqualTo
subtraction_2 = Subtraction(A=num_6, B=subtraction)
cull = CullPattern(List=crv, CullPattern=larger.LargerThan)
cull_2 = CullPattern(List=len, CullPattern=larger.LargerThan)
maximalbreite_fenster = Slider(2, range=0..10)
num_8 = Number(graph_2)
remap = RemapNumbers(Value=cull_2, Source=Domain(0, 1), Target=graph)  # -> Mapped, Clipped
graph_3 = GraphMapper(
    num_8,
    x0=0,
    x1=1,
    y0=0,
    y1=1,
    A=1,
    B=0,
    container_name="Linear",
    Graph_x0=0.25,
    Graph_x1=0.75,
    Graph_y0=0.25,
    Graph_y1=0.75)
graph_4 = GraphMapper(num_8, x0=0, x1=1, y0=0, y1=1, container_name="Bezier", cpx=[0, 0, 0.1790605038, 1], cpy=[0, 0, 0.6775124073, 1])
division = Division(A=remap.Mapped, B=maximalbreite_fenster)
round = Round(Number=division)  # -> Nearest, Floor, Ceiling
remap_2 = RemapNumbers(Value=subtraction_2, Source=Domain(0, 1), Target=graph_4)  # -> Mapped, Clipped
remap_3 = RemapNumbers(Value=subtraction, Source=Domain(0, 1), Target=graph_3)  # -> Mapped, Clipped
addition = Addition(A=remap_2.Mapped, B=remap_3.Mapped)
# Anzahl Fenster der Seite
anzahl_fenster_der_seite = Number(round.Ceiling)
panel_6 = Panel(round.Ceiling)
Z = UnitZ(Factor=remap_3.Mapped)
panel_7 = Panel("Einzelkurven der Himmelsrichtung")
division_2 = Division(A=remap.Mapped, B=round.Ceiling)
num_9 = Number(addition)
crv_2 = Curve(cull)
divide = DivideCurve(Curve=crv_2, Count=anzahl_fenster_der_seite, Kinks=False)  # -> Points, Tangents, Parameters
multiplication = Multiplication(A=num_9, B=remap.Mapped)
multiplication_2 = Multiplication(A=len, B=num_6)
item = ListItem(List=divide.Tangents, Index=Slider(0, range=0..100), Wrap=True)
shatter = Shatter(Curve=graft(crv_2), Parameters=divide.Parameters)
division_3 = Division(A=multiplication, B=multiplication_2)
midpt = CurveMiddle(Curve=shatter)
Z_2 = UnitZ(Factor=num_7)
wwr_actual = Number(division_3)
move = Move(Geometry=midpt, Motion=Z_2)  # -> Geometry, Transform
panel_9 = Panel(wwr_actual)
multiplication_3 = Multiplication(A=division_2, B=item)
panel_10 = Panel("WWR Actual")
Z_3 = UnitZ(Factor=1)
multiplication_4 = Multiplication(A="-0.5", B=multiplication_3)
extr = Extrude(Base=shatter, Direction=Z_3)
move_2 = Move(Geometry=move.Geometry, Motion=multiplication_4)  # -> Geometry, Transform
md_slider = MDSlider(SliderMode=0, slider_value=Point(0.5, 0.5, 0.5), x_domain=Domain(0, 1), y_domain=Domain(0, 1), z_domain=Domain(0, 1))
evalsrf = EvaluateSurface(Surface=reparameterize(extr), Point=md_slider)  # -> Point, Normal, UDirection, VDirection, Frame
cullpt = CullDuplicates(Points=move_2.Geometry, Tolerance=0.1, CullMode=3)  # -> Points, Indices, Valence
vec = Vector(item)
pl = ConstructPlane(Origin=move_2.Geometry, XAxis=item, YAxis=evalsrf.Normal)
num_10 = ClusterInput()
panel_11 = Panel("Dicke Wandaufbau gesamt")
num_11 = Number(num_10)
rectangle = Rectangle(Plane=pl, XSize=division_2, YSize=num_11, Radius=0)  # -> Rectangle, Length
panel_12 = Panel("Höhe über Auenhöhe")
move_3 = Move(Geometry=rectangle.Rectangle, Motion=Z)  # -> Geometry, Transform
move_4 = Move(Geometry=move_2.Geometry, Motion=Z)  # -> Geometry, Transform
panel_13 = Panel("Höhe Fenster Gesamt")
clean = CleanTree(RemoveNulls=True, RemoveInvalid=True, RemoveEmpty=Toggle(True), Tree=move_3.Geometry)
neg = Negative(Value=num_9)
boxrec = BoxRectangle(Rectangle=clean, Height=neg)
B = ClusterOutput(boxrec)
panel_14 = Panel("Breite Fenster")
num_12 = Number(division_2)
item_2 = ListItem(List=divide.Tangents, Index="1", Wrap=True)
multiplication_5 = Multiplication(A=num_12, B="0.5")
item_3 = ListItem(List=vec, Index="1", Wrap=True)
multiplication_6 = Multiplication(A=multiplication_5, B=item_2)
item_4 = ListItem(List=evalsrf.Normal, Index="1", Wrap=True)
move_5 = Move(Geometry=move_4.Geometry, Motion=multiplication_6)  # -> Geometry, Transform
vec_2 = Vector(item_3)
panel_17 = Panel("Fenster Höhe")
cullpt_2 = CullDuplicates(Points=move_5.Geometry, Tolerance=0.1, CullMode=3)  # -> Points, Indices, Valence
multiplication_7 = Multiplication(A=vec_2, B=num_12)
num_13 = Number(num_9)
num_14 = Number(num_11)
pt_4 = Point(cullpt_2.Points)
neg_2 = Negative(Value=num_13)
multiplication_8 = Multiplication(A=item_4, B=num_14)
Z_4 = UnitZ(Factor=neg_2)
multiplication_9 = Multiplication(A=multiplication_7, B="0.5")
multiplication_10 = Multiplication(A=multiplication_7, B="-0.5")
panel_18 = Panel("Innere Ecken Oben")
panel_19 = Panel("Innere Ecken Unten")
move_6 = Move(Geometry=pt_4, Motion=multiplication_9)  # -> graft(Geometry), Transform
move_7 = Move(Geometry=pt_4, Motion=multiplication_10)  # -> graft(Geometry), Transform
move_8 = Move(Geometry=move_7.Geometry, Motion=Z_4)  # -> Geometry, Transform
move_9 = Move(Geometry=move_6.Geometry, Motion=Z_4)  # -> Geometry, Transform
panel_20 = Panel("Äußere Ecken Oben")
panel_21 = Panel("Äußere Ecken Unten")
move_10 = Move(Geometry=move_6.Geometry, Motion=multiplication_8)  # -> Geometry, Transform
move_11 = Move(Geometry=move_10.Geometry, Motion=Z_4)  # -> Geometry, Transform
move_12 = Move(Geometry=move_7.Geometry, Motion=multiplication_8)  # -> Geometry, Transform
move_13 = Move(Geometry=move_12.Geometry, Motion=Z_4)  # -> Geometry, Transform
panel_22 = Panel(move_11.Geometry)
pline = PolyLine(Vertices=[move_9.Geometry, move_11.Geometry, move_13.Geometry, move_8.Geometry], Closed=Toggle(True))
pline_2 = PolyLine(Vertices=[move_6.Geometry, move_7.Geometry, move_12.Geometry, move_10.Geometry], Closed=Toggle(True))
pline_3 = PolyLine(Vertices=[move_6.Geometry, move_10.Geometry, move_11.Geometry, move_9.Geometry], Closed=Toggle(True))
pline_4 = PolyLine(Vertices=[move_12.Geometry, move_7.Geometry, move_8.Geometry, move_13.Geometry], Closed=Toggle(True))
fpatch = FragmentPatch(Boundary=pline)
fpatch_2 = FragmentPatch(Boundary=pline_2)
fpatch_3 = FragmentPatch(Boundary=pline_3)
fpatch_4 = FragmentPatch(Boundary=pline_4)
panel_23 = Panel("Tangente Vektor")
panel_24 = Panel("Dicke Rahmen")
panel_25 = Panel("Oben")
panel_26 = Panel("Unten")
panel_27 = Panel("1")
panel_28 = Panel("2")
vec_3 = Vector(vec)
item_5 = ListItem(List=vec_3, Index="1", Wrap=True)
dicke_rahmen = Slider(0.03, range=0..0.1)
num_15 = Number(dicke_rahmen)
neg_3 = Negative(Value=num_15)
Z_5 = UnitZ(Factor=neg_3)
move_14 = Move(Geometry=move_7.Geometry, Motion=Z_5)  # -> Geometry, Transform
move_15 = Move(Geometry=move_6.Geometry, Motion=Z_5)  # -> Geometry, Transform
join = BrepJoin(Breps=[fpatch, fpatch_3, fpatch_4, pline_2])  # -> Breps, Closed
multiplication_11 = Multiplication(A=item_5, B=dicke_rahmen)
panel_30 = Panel("Dicke Fußplatte")
vec_4 = Vector(multiplication_11)
offsetbrep = OffsetBrep(Brep=join.Breps, OffsetDistance=dicke_rahmen, Solid=Toggle(True), SharpEdges=True, Tolerance=0.01)
rev = Reverse(Vector=vec_4)
output_fensterrahmen = Data(offsetbrep)
num_16 = Number(dicke_rahmen)
num_17 = Number(dicke_rahmen)
move_16 = Move(Geometry=move_15.Geometry, Motion=rev)  # -> Geometry, Transform
move_17 = Move(Geometry=move_14.Geometry, Motion=vec_4)  # -> Geometry, Transform
num_18 = Number(num_13)
output_fensterrahmen_2 = ClusterOutput(output_fensterrahmen)
addition_2 = Addition(A=num_16, B=num_17)
subtraction_3 = Subtraction(A=num_18, B=addition_2)
panel_32 = Panel("Türblatt Grundform")
neg_4 = Negative(Value=subtraction_3)
Z_6 = UnitZ(Factor=neg_4)
move_18 = Move(Geometry=move_16.Geometry, Motion=Z_6)  # -> Geometry, Transform
move_19 = Move(Geometry=move_17.Geometry, Motion=Z_6)  # -> Geometry, Transform
pline_5 = PolyLine(Vertices=[move_17.Geometry, move_16.Geometry, move_18.Geometry, move_19.Geometry], Closed=Toggle(True))
fpatch_5 = FragmentPatch(Boundary=pline_5)
panel_33 = Panel("Normal Vektor Wand")
vec_5 = Vector(evalsrf.Normal)
num_19 = Number(num_11)
item_6 = ListItem(List=vec_5, Index="1", Wrap=True)
multiplication_12 = Multiplication(A=num_19, B=Slider(0.5, range=0..1))
multiplication_13 = Multiplication(A=item_6, B=multiplication_12)
move_20 = Move(Geometry=fpatch_5, Motion=multiplication_13)  # -> Geometry, Transform
G = ClusterOutput(move_20.Geometry)
offsrf = OffsetSurface(Surface=move_20.Geometry, Distance=Slider(0.05, range=0..0.1), BothSides=0, CreateSolid=True)
output_glas = Data(offsrf)
output_glas_2 = ClusterOutput(output_glas)

# ==== cluster Cluster_2
wand = ClusterInput()
grundriss = ClusterInput()
wand_2 = Curve(wand)
grundriss_2 = Curve(grundriss)
snapping_edge = Slider(3, range=0..25)
eval = EvaluateCurve(Curve=reparameterize(grundriss_2), Parameter=".25")  # -> Point, Tangent, Angle
debrep = DeconstructBrep(Brep=wand_2)  # -> Faces, Edges, Vertices
panel = Panel(""".25
.75""")
pl = PlaneNormal(Origin=eval.Point, ZAxis=eval.Tangent)
eval_2 = EvaluateCurve(Curve=reparameterize(grundriss_2), Parameter=panel)  # -> Point, Tangent, Angle
item = ListItem(List=debrep.Vertices, Index=snapping_edge, Wrap=True)
A = ClusterInput()
crv_cp = CurveClosestPoint(Point=eval_2.Point, Curve=grundriss_2)  # -> Point, Parameter, Distance
pln = Plane(item)
rot3d = Rotate3D(Geometry=pl, Angle=degrees(A), Center=eval.Point, Axis=eval.Tangent)  # -> Geometry, Transform
shatter = Shatter(Curve=grundriss_2, Parameters=crv_cp.Parameter)
orient = Orient(Geometry=wand_2, Source=pln, Target=rot3d.Geometry)  # -> Geometry, Transform
swp1 = Sweep1(Rail=shatter, Sections=orient.Geometry, Miter=1)
join = BrepJoin(Breps=flatten(swp1))  # -> Breps, Closed
B = ClusterOutput(join.Breps)
